# Grasshopper definition 181105_clay_impact_topdown.gh (Grasshopper 1.0.7)
# plug-ins: Human

# ---- group: input 2 curves
lower_crv = Curve(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)
upper_crv = Curve(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)

# ----
loft = Loft(
    Curves=[lower_crv, upper_crv],
    Options={Adjust=True, Closed=False, LoftEnds=0, LoftSimp=0, LoftType=0, Rebuild=10, Refit=0.01})
v = Slider(0.523, range=0..1)
srf_prep = GhPythonScript(srf=loft, u=Slider(0.62, range=0..1), v=v)  # -> out, srf, pt, fr, a, corners; inputs srf: Surface
# ---------- srf_prep: Python ----------
import Rhino.Geometry as rg

srf = srf.Rebuild(3,3,50,50)

u_dom = srf.Domain(0)
v_dom = srf.Domain(1)

srf.SetDomain(0, rg.Interval(0,1))
srf.SetDomain(1, rg.Interval(0,1))

u_dom = srf.Domain(0)
v_dom = srf.Domain(1)


pt = srf.PointAt(u, v)

boolean, fr = srf.FrameAt(u, v)

umin = srf.Domain(0).Min
umax = srf.Domain(0).Max

vmin = srf.Domain(1).Min
vmax = srf.Domain(1).Max


print umin, "----", umax
print vmin, "----", vmax

p1 = srf.PointAt(umin, vmin)
p2 = srf.PointAt(umin, vmax)

p3 = srf.PointAt(umax, vmin)
p4 = srf.PointAt(umax, vmax)

a = p1, p2, p3, p4

corners = []

corners = [p1, p2, p3, p4]

print corners
# ---------- end srf_prep ----------
subdivision = GhPythonScript(srf=srf_prep.srf)  # -> out, pt_list, bullets, pts_h_list, pts_mid_list, frames_list, isoc_list; inputs srf: Surface
# ---------- subdivision: Python ----------
import Rhino.Geometry as rg
import scriptcontext as sc
import ghpythonlib.components as gh

Bullet = sc.sticky["BulletClass"]

class PopulatedSurface(object):
    """A surface populated with bullets.
    """
    
    def __init__(self, srf, n1, n2):
        """Attributes:
           srf (Surface): base surface to populate
        """
        
        self.srf = srf
        self.bullets = []
        
        srf.SetDomain(0, rg.Interval(0,1))
        srf.SetDomain(1, rg.Interval(0,1))
        self.pts, self.pts_h, self.pts_mid, self.frames, self.isocs = self.get_bullet_grid(n1, n2)
        
    def get_bullet_grid(self, n1, n2):
        """Returns Bullet objects on surface.
        """
        pts = []
        pts_h = []
        pts_mid = []
        frames = []
        isocs = []
        
        u = self.srf.Domain(0).Min
        v = self.srf.Domain(1).Min
        
        d1 = self.srf.Domain(0).Length / n1
        d2 = self.srf.Domain(1).Length / n2

        v_mid = v + d2/2
        
        for j in range(0, n2+1):
            u = self.srf.Domain(0).Min
            u_h = u + d1
            for i in range(0, n1):
                pt = self.srf.PointAt(u,v)
                pt_h = self.srf.PointAt(u_h, v)
                pt_mid = self.srf.PointAt(u, v_mid)
                
                pt_close_uv = gh.SurfaceClosestPoint(pt_h, self.srf)[1]
                isoc = gh.IsoCurve(self.srf, pt_close_uv)
                isocs.append(isoc[1])
                
                radius = pt.DistanceTo(pt_mid)

                closest = gh.CurveClosestPoint(pt, isoc[1])
                height = closest[2]

                if i % 2 == 0:
                    fr = self.srf.FrameAt(u,v)[1]
                    fr = gh.AlignPlane(fr, gh.UnitZ(1))[0]
                    fr_x = rg.Plane(fr.Origin, fr.XAxis)
                    
                else:
                    fr = self.srf.FrameAt(u,v_mid)[1]
                    fr = gh.AlignPlane(fr, gh.UnitZ(1))[0]
                    fr_x = rg.Plane(fr.Origin, fr.XAxis)
                
                b = Bullet(fr_x, radius, height)
                
                pts.append(pt)
                pts_h.append(pt_h)
                pts_mid.append(pt_mid)
                frames.append(fr)
                
                self.bullets.append(b.cyl)
                
                u += d1
                u_h = u + d1
                
            v += d2
            v_mid = v + d2/2
            
        return pts, pts_h, pts_mid, frames, isocs

populated_srf = PopulatedSurface(srf, 10, 30)

pt_list = populated_srf.pts
bullets = populated_srf.bullets
pts_h_list = populated_srf.pts_h
pts_mid_list = populated_srf.pts_mid
frames_list = populated_srf.frames
isoc_list = populated_srf.isocs
# ---------- end subdivision ----------
bullet_class = GhPythonScript()  # -> out
# ---------- bullet_class: Python ----------
import Rhino.Geometry as rg
import scriptcontext as sc

class Bullet(object):
    """Simple bullet of clay.
    """
    
    def __init__(self, origin_plane, radius, height):
        """Attributes:
        origin_plane (Plane): the base of the bullet
        radius (float): radius of bullet
        height (float): height of bullet
        """
        
        self.o_plane = origin_plane
        self.radius = radius
        self.height = height
        self.cyl = self.generate_geo()
        
    def generate_geo(self):
        """Generate bullet geometry.
        """
        cyl = rg.Cylinder(rg.Circle(self.o_plane, self.radius), self.height)
        return cyl

sc.sticky["BulletClass"] = Bullet
# ---------- end bullet_class ----------
geo = Geometry(srf_prep.srf)
geo_2 = Geometry(srf_prep.pt)
geo_3 = Geometry(srf_prep.fr)
geo_4 = Geometry(srf_prep.a)
geo_5 = Geometry(srf_prep.corners)
geo_6 = Geometry(subdivision.pt_list)
geo_7 = Geometry(subdivision.bullets)
geo_8 = Geometry(subdivision.pts_h_list)
geo_9 = Geometry(subdivision.pts_mid_list)
geo_10 = Geometry(subdivision.frames_list)
geo_11 = Geometry(subdivision.isoc_list)

# ---- group: viz outputs
preview = CustomPreview(Geometry=geo_6, Material=ColourSwatch(SwatchColor=RGB(255, 33, 137)))
preview_2 = CustomPreview(Geometry=geo_8, Material=ColourSwatch(SwatchColor=RGB(207, 255, 36)))
preview_3 = CustomPreview(Geometry=geo_9, Material=ColourSwatch(SwatchColor=RGB(33, 251, 255)))
preview_4 = CustomPreview(Geometry=geo_7, Material=ColourSwatch(SwatchColor=RGBA(245, 255, 54, 156)))
previewlw = CustomPreviewLineweights(Geometry=geo_11, Shader=ColourSwatch(SwatchColor=RGB(255, 33, 33)), Thickness=Slider(2, range=0..10), Absolute=True)

# ---- group: viz normal
deplane = DeconstructPlane(Plane=geo_3)  # -> Origin, XAxis, YAxis, ZAxis
multiplication = Multiplication(A=deplane.ZAxis, B=50)
vdisex = VectorDisplayEx(
    Point=deplane.Origin,
    Vector=multiplication,
    Colour=ColourSwatch(SwatchColor=RGB(255, 36, 36)),
    Width=Slider(7, range=0..100))
