# Grasshopper definition ImpactPrinting_Module_v3.gh (Grasshopper 1.0.7)

iterations = Slider(50, range=0..100)
iterations_2 = Slider(50, range=0..100)
iterations_3 = Slider(50, range=0..100)
curve = Curve(<curve referenced from the Rhino model>)
point = Point(<point referenced from the Rhino model>)
point_2 = Point(<point referenced from the Rhino model>)
point_3 = Point(<point referenced from the Rhino model>)
vertical_growth_3 = GhPythonScript(origin_pt=point_3, iterations=iterations_3)  # -> out, bullets, cylinders; inputs origin_pt: Point3d, iterations: Int32
# ---------- vertical_growth_3: Python ----------
"""Random non-vertical growth of bullets.

author: David Jenny
"""

import scriptcontext as sc
Bullet = sc.sticky["BulletClass"]

import random as r
import math as m

import Rhino.Geometry as rg

bullets = []
cylinders = []

actuator_radius = 6
actuator_height = 25

first_bullet = Bullet(rg.Plane(origin_pt,rg.Vector3d.ZAxis),actuator_radius,actuator_height)
first_bullet.generate_cylinder(25)
bullets.append(first_bullet)
cylinders.append(first_bullet.cylinder)

for i in range(iterations):
    dz = r.randint(5,25)
    
    rx = r.randint(-15,15)
    ry = r.randint(-15,15)
    
    temp_plane = rg.Plane(bullets[-1].o_plane)
    temp_plane.Rotate(m.radians(rx),temp_plane.XAxis,temp_plane.Origin)
    temp_plane.Rotate(m.radians(ry),temp_plane.YAxis,temp_plane.Origin)
    
    
    temp_plane.Translate(temp_plane.ZAxis * bullets[-1].h)
    temp_bullet = Bullet(temp_plane, 6, 25)
    temp_bullet.generate_cylinder(dz)
    bullets.append(temp_bullet)
    cylinders.append(temp_bullet.cylinder)
# ---------- end vertical_growth_3 ----------
vertical_growth_2 = GhPythonScript(origin_pt=point_2, iterations=iterations_2)  # -> out, bullets, cylinders; inputs origin_pt: Point3d, iterations: Int32
# ---------- vertical_growth_2: Python ----------
"""Random vertical growth with inclination of bullets.

author: David Jenny
"""

import scriptcontext as sc
Bullet = sc.sticky["BulletClass"]

import Rhino.Geometry as rg
import random as r

bullets = []
cylinders = []

actuator_radius = 6
actuator_height = 25

first_bullet = Bullet(rg.Plane(origin_pt,rg.Vector3d.ZAxis),actuator_radius,actuator_height)
first_bullet.generate_cylinder(25)
bullets.append(first_bullet)
cylinders.append(first_bullet.cylinder)

for i in range(iterations):
    dz = r.randint(5,25)
    dx = r.randint(-5,5)
    dy = r.randint(-5,5)
    translate = rg.Vector3d(dx,dy,bullets[-1].h)
    
    temp_plane = rg.Plane(bullets[-1].o_plane)
    temp_plane.Translate(translate)
    temp_bullet = Bullet(temp_plane, 6, 25)
    temp_bullet.generate_cylinder(dz)
    bullets.append(temp_bullet)
    cylinders.append(temp_bullet.cylinder)
# ---------- end vertical_growth_2 ----------
# Topics
# 
# single-bullet
# doublette
# triplette
# etc.
# 
# along curves, lines, etc.
# 
# different distances, heights, cylinders
# 
# growing arches, triangles, etc.
# 
# growing pyramides, cones, etc.
# 
# growing volumes, volumetric approach, etc.
# 
# growing paths and overlapping paths, etc.
bulletclass = GhPythonScript()  # -> out
# ---------- bulletclass: Python ----------
"""Simple bullet class.

author: David Jenny
"""


import scriptcontext as sc
import Rhino.Geometry as rg
import math as m

actuator_len = 25


class Bullet(object):
    """Describes one discrete bullet particle.
    """
    def __init__(self, origin_plane, actuator_radius, actuator_height):
        self.o_plane = origin_plane
        self.ar = actuator_radius
        self.ah = actuator_height
        self.volume = m.pi* self.ar**2 * self.ah
        
        self.geom = []
    
    def generate_cylinder(self, height):
        new_radius = m.sqrt(self.volume / height / m.pi)
        self.h = height
        
        self.cylinder = rg.Cylinder(rg.Circle(self.o_plane, new_radius), height)
        self.geom.append(self.cylinder)

if __name__ == "__main__":
    test_bullet = Bullet(rg.Plane.WorldXY, 6, actuator_len)
    test_bullet.generate_cylinder(10)
    print test_bullet.volume

sc.sticky["BulletClass"] = Bullet
# ---------- end bulletclass ----------
alongcurve = GhPythonScript(crv=curve)  # -> out, bullets, cylinders; inputs crv: Curve
# ---------- alongcurve: Python ----------
"""Distribution of bullets along a curve.

author: David Jenny
"""


import scriptcontext as sc
Bullet = sc.sticky["BulletClass"]

import Rhino.Geometry as rg

len = crv.GetLength()
dist = 10
no = int(len/10)
params = crv.DivideByCount(no, True)
points = [crv.PointAt(p) for p in params]
planes = [rg.Plane(pt,rg.Vector3d.ZAxis) for pt in points]

bullets = [Bullet(plane,6,25) for plane in planes]

cylinders = []
for i,b in enumerate(bullets):
    b.generate_cylinder(25)
    cylinders.append(b.cylinder)
# ---------- end alongcurve ----------
vertical_growth_1 = GhPythonScript(origin_pt=point, iterations=iterations)  # -> out, bullets, cylinders; inputs origin_pt: Point3d, iterations: Int32
# ---------- vertical_growth_1: Python ----------
"""Random vertical growth of bullets.

author: David Jenny
"""


import scriptcontext as sc
Bullet = sc.sticky["BulletClass"]

import Rhino.Geometry as rg
import random as r

bullets = []
cylinders = []

total_height = 0
for i in range(iterations):
    temp_height = r.randint(5,25)
    temp_plane = rg.Plane(rg.Point3d(origin_pt) + rg.Vector3d(0,0,total_height), rg.Vector3d.ZAxis)
    temp_bullet = Bullet(temp_plane, 6, 25)
    temp_bullet.generate_cylinder(temp_height)
    bullets.append(temp_bullet)
    cylinders.append(temp_bullet.cylinder)
    total_height += temp_height
# ---------- end vertical_growth_1 ----------
