# Grasshopper definition 181015_SpatialAggregations_ghModule_DJ.gh (Grasshopper 1.0.7)

# ---- group: Design Generation
number_slider = Slider(10, range=0..10)
construct_point = ConstructPoint(XCoordinate=0, YCoordinate=0, ZCoordinate=0)
ghpython_script = GhPythonScript(origin_pt=construct_point, x_size=number_slider, y_size=number_slider)  # -> out, lengths, planes; inputs origin_pt: Point3d, x_size: Int32, y_size: Int32
# ---------- ghpython_script: Python ----------
import Rhino.Geometry as rg
import random as r

lengths = []
planes = []

for i in range(x_size):
    for j in range(y_size):
        temp_len = r.randint(50, 150)
        temp_pt = rg.Point3d(i*50,j*50,0)
        temp_vec = rg.Vector3d(r.uniform(0,0.3),r.uniform(0,0.3),r.uniform(0.8,1.2))
        temp_plane = rg.Plane(temp_pt,temp_vec)
        
        lengths.append(temp_len)
        planes.append(temp_plane)
# ---------- end ghpython_script ----------

# ---- group: Generate list of elements
ghpython_script_2 = GhPythonScript(lengths=ghpython_script.lengths, planes=ghpython_script.planes)  # -> out, sticks, stick_lines, stick_cylinders; inputs lengths: list of Int32, planes: list of Plane
# ---------- ghpython_script_2: Python ----------
import scriptcontext as sc
Stick = sc.sticky['StickClass']


sticks = []
stick_lines = []
stick_cylinders = []
for i,plane in enumerate(planes):
    temp_stick = Stick(plane,lengths[i])
    sticks.append(temp_stick)
    stick_lines.append(temp_stick.axis)
    stick_cylinders.append(temp_stick.cylinder)
# ---------- end ghpython_script_2 ----------

# ---- group: Class
stick_class = GhPythonScript()  # -> out
# ---------- stick_class: Python ----------
import Rhino.Geometry as rg
import scriptcontext as sc


class Stick(object):
    """Simple round profile element.
    """
    def __init__(self, origin_plane, length):
        self.o_plane = origin_plane
        self.len = length
        self.radius = 2
        
        self.generate_geom()
        
    def generate_geom(self):
        self.axis = rg.Line(self.o_plane.Origin, self.o_plane.ZAxis, self.len)
        self.cylinder = rg.Cylinder(rg.Circle(self.o_plane, self.radius), self.len)


sc.sticky['StickClass'] = Stick
# ---------- end stick_class ----------

# ----
ghpython_script_3 = GhPythonScript(sticks=ghpython_script_2.sticks)  # -> out, cylinders; inputs sticks: list
# ---------- ghpython_script_3: Python ----------
import scriptcontext as sc

Stick = sc.sticky['StickClass']
connect_two_sticks = sc.sticky['function']

new_sticks = []
for i,stick in enumerate(sticks):
    if i < len(sticks) - 1:
        temp_stick = connect_two_sticks(stick, 0.2, 1, sticks[i+1], 0.8, -1)
        new_sticks.append(temp_stick)
        

cylinders = [stick.cylinder for stick in new_sticks]
# ---------- end ghpython_script_3 ----------
list_item = ListItem(List=ghpython_script_2.sticks, Index=0, Wrap=True)
list_item_2 = ListItem(List=ghpython_script_2.sticks, Index=1, Wrap=True)
list_item_3 = ListItem(List=ghpython_script_2.stick_cylinders, Index=0, Wrap=True)
list_item_4 = ListItem(List=ghpython_script_2.stick_cylinders, Index=1, Wrap=True)
connect_two_sticks = GhPythonScript(s_A=list_item, s_B=list_item_2, p_A=Slider(0.2, range=0..1), p_B=Slider(0.8, range=0..1))  # -> out, temp_geom, connected_stick, connected_stick_cylinder
# ---------- connect_two_sticks: Python ----------
import Rhino.Geometry as rg
import scriptcontext as sc

Stick = sc.sticky['StickClass']

temp_geom = []

def connect_two_sticks(stick_A, param_A, bypass_mode_A, stick_B, param_B, bypass_mode_B):
    """Creates a new element between two existing sticks
    """
    
    pt_A = stick_A.axis.PointAt(param_A)
    pt_B = stick_B.axis.PointAt(param_B)
    temp_geom.extend([pt_A, pt_B])
    
    # new axis - this will later be adjusted
    line_C = rg.Line(pt_A,pt_B)
    temp_geom.append(line_C)
    
    axis_a_curve = stick_A.axis.ToNurbsCurve()
    axis_b_curve = stick_B.axis.ToNurbsCurve()
    line_c_curve = line_C.ToNurbsCurve()
    
    plane_A = rg.Plane(pt_A,axis_a_curve.PointAtStart, line_c_curve.PointAtEnd)
    if plane_A == None:
       print 'problem'
    
    plane_B = rg.Plane(pt_B,axis_b_curve.PointAtStart, line_c_curve.PointAtStart)
    if plane_B == None:
       print 'problem'
       
    temp_geom.extend([plane_A,plane_B])
    
    # parameters
    clearance_A =1
    clearance_B = 1
    min_clearance = 0.1
    
    buffer_counter_A = 1.0
    buffer_counter_B = 1.0
    
    off_line_C = None
    while_loop_counter = 0
    
    radius = stick_A.radius * 2
    buffer = radius
    
    while (clearance_A < (radius * 2 +min_clearance)) or (clearance_B < (radius * 2 +min_clearance)):
        while_loop_counter += 1
        if while_loop_counter >20:
            break
        
        normal_A = plane_A.ZAxis
        if normal_A[2] < 0:
            normal_A.Reverse()
        
        normal_B = plane_B.ZAxis
        if normal_B[2] < 0:
            normal_B.Reverse() 
        
        off_vec_A = rg.Vector3d.Multiply(bypass_mode_A*buffer*buffer_counter_A, normal_A)
        off_vec_B = rg.Vector3d.Multiply(bypass_mode_B*buffer*buffer_counter_B, normal_B)
        
        off_pt_A = pt_A + off_vec_A
        off_pt_B = pt_B + off_vec_B
        
        off_line_C = rg.Line(off_pt_A, off_pt_B)
        
        connection_pts_A = rg.Intersect.Intersection.LineLine(off_line_C, stick_A.axis)
        connection_pts_B = rg.Intersect.Intersection.LineLine(off_line_C, stick_B.axis)
        
        clearance_A = stick_A.axis.PointAt(connection_pts_A[1]).DistanceTo(stick_A.axis.PointAt(connection_pts_A[2])) 
        clearance_B = stick_B.axis.PointAt(connection_pts_B[1]).DistanceTo(stick_B.axis.PointAt(connection_pts_B[2])) 
        
        if clearance_A < (buffer + min_clearance):
            buffer_counter_A += 0.1
        if clearance_B < (buffer + min_clearance):
            buffer_counter_B += 0.1
        
        off_line_C = rg.LineCurve(off_line_C)
        
    vec_C = off_line_C.PointAtStart - off_line_C.PointAtEnd
    plane_C = rg.Plane(off_line_C.PointAtStart, -vec_C)
    
    connected_stick = Stick(plane_C, off_line_C.GetLength())
    return connected_stick

connected_stick = connect_two_sticks(s_A, p_A, 1, s_B, p_B, 1)
connected_stick_cylinder = connected_stick.cylinder

sc.sticky['function'] = connect_two_sticks
# ---------- end connect_two_sticks ----------
geometry = Geometry(connect_two_sticks.temp_geom)
