# Grasshopper definition 180927_elective_setup [Sep-27 '18, 1302].gh (Grasshopper 1.0.7)

# ----
# 0a
# Settings
# Check your IP address and set UR IP address
server_address = ValueList({"192.168.10.12", "192.168.10.11", "192.168.10.10", "127.0.0.1"}, selected="192.168.10.10")
server_port = Integer(30003)
ur_ip = ValueList({"192.168.10.12", "192.168.10.11", "192.168.10.10", "127.0.0.1"}, selected="192.168.10.11")
globals = PythonScript(server_address=server_address, server_port=server_port, ur_ip=ur_ip)  # inputs server_port: Int32
# ---------- globals: Python ----------
from scriptcontext import sticky as st

st["server_address"] = server_address
st["server_port"] = server_port

st["ur_ip"] = ur_ip
# ---------- end globals ----------

# ----
# Check if UR is available
ping = Button()
py = PythonScript(ip=ur_ip, ping=ping)  # -> out
# ---------- py: Python ----------
from scriptcontext import sticky as st
from ur_online_control.communication import is_available


guid = str(ghenv.Component.InstanceGuid)
txt_key = "txt_" + guid
if txt_key not in st:
    st[txt_key] = ""

if ping:
    
    available = is_available(ip)
    
    if available:
        st[txt_key] = "%s is up!" % ip
    else:
        st[txt_key] = "%s is down!" % ip

print st[txt_key]
# ---------- end py ----------
panel = Panel(py)

# ----
# 0a
# Settings
# Check your IP address and set UR IP address
server_address_2 = ValueList({"192.168.10.12", "192.168.10.11", "192.168.10.2", "127.0.0.1"}, selected="192.168.10.11")
ur_ip_2 = ValueList({"192.168.10.13", "192.168.10.11", "192.168.10.10", "127.0.0.1"}, selected="192.168.10.10")
server_port_2 = Integer(30003)
globals_2 = PythonScript(server_address=server_address_2, server_port=server_port_2, ur_ip=ur_ip_2)  # inputs server_port: Int32; same code as globals

# ----
# Check if UR is available
ping_2 = Button()
py_2 = PythonScript(ip=ur_ip_2, ping=ping_2)  # -> out; same code as py
panel_2 = Panel(py_2)

panel_3 = Panel("Unload libraries")
bang = Button()
unload = PythonScript(bang=bang)
# ---------- unload: Python ----------
from compas_ghpython import unload_modules

unload_modules("compas")
unload_modules("ur_online_control")
# ---------- end unload ----------

bang_2 = Button()
unload_2 = PythonScript(bang=bang_2)  # same code as unload

# ---- group: Robot
# 1. load robot model
# 2. set tool
# 3. set basis
list = ValueList({"no_tool": 0, "measurement_tool": 1, "sand_tool": 2}, selected="sand_tool")
tools = Tools(tool_id=list)
base = PythonScript()  # -> base_frame
# ---------- base: Python ----------
from compas.geometry import Frame

"""
origin = [0, 0, 0]
xaxis = [1, 0, 0]
yaxis = [0, 1, 0]


origin = [-313.92, -147.58, 13.79]
xaxis = [0.00000, -1.00000, 0.00000]
yaxis = [1.00000, 0.00000, 0.00000]
"""

"""
origin = [0, 0, 0]
xaxis = [0, -1, 0]
yaxis = [1, 0, 0]
"""

origin = [306.61, 371.04, 28.24]
xaxis = [0.00000, 1.00000, 0.00000]
yaxis = [-1.00000, 0.00000, 0.00000]

base_frame = Frame(list(origin), list(xaxis), list(yaxis))
# ---------- end base ----------
list_2 = ValueList({"UR5", "UR10"}, selected="UR5")
# 1
robot = PythonScript(model=list_2, tool=tools, base_frame=base)  # -> robot
# ---------- robot: Python ----------
from ur_online_control.ur.ur10 import UR10
from ur_online_control.ur.ur5 import UR5
from scriptcontext import sticky as st

if model == "UR5":
    robot = UR5()
elif model == "UR10":
    robot = UR10()

if tool:
    robot.set_tool(tool)
if base_frame:
    robot.set_base(base_frame)

st["robot"] = robot
# ---------- end robot ----------

# ----
origin_pt = Point(<point referenced from the Rhino model>)
xy = XYPlane(Origin=origin_pt)

# ---- group: Robot
# 1. load robot model
# 2. set tool
# 3. set basis
list_3 = ValueList({"no_tool": 0, "measurement_tool": 1, "extruder": 2}, selected="extruder")
tools_2 = Tools_2(tool_id=list_3)
base_2 = PythonScript()  # -> base_frame
# ---------- base_2: Python ----------
from compas.geometry import Frame

"""
origin = [0, 0, 0]
xaxis = [1, 0, 0]
yaxis = [0, 1, 0]


origin = [-313.92, -147.58, 13.79]
xaxis = [0.00000, -1.00000, 0.00000]
yaxis = [1.00000, 0.00000, 0.00000]
"""


origin = [155.98, -806.21, 343.76]
xaxis = [0, 0, 1]
yaxis = [1, 0, 0]

base_frame = Frame(list(origin), list(xaxis), list(yaxis))
# ---------- end base_2 ----------
list_4 = ValueList({"UR5", "UR10"}, selected="UR10")
robot_2 = PythonScript(model=list_4, tool=tools_2, base_frame=base_2)  # -> robot; same code as robot

# ----
python = GhPythonScript(
    o_plane=xy,
    x_size=Slider(400, range=0..1000),
    y_size=Slider(400, range=0..1000),
    x_no=Slider(10, range=0..10),
    y_no=Slider(10, range=0..10))  # -> out, way_pts, waiting_times; inputs o_plane: Plane, x_size: Int32, y_size: Int32, x_no: Int32, y_no: Int32
# ---------- python: Python ----------
__author__ = "jesusm"
__version__ = "2018.09.04"

import Rhino.Geometry as rg
import rhinoscriptsyntax as rs

import random as r

x_dist = x_size/x_no
y_dist = y_size/y_no

way_pts = []
waiting_times = []

for i in range(x_no + 1):
    for j in range(y_no + 1):
        temp_pt = o_plane.Origin + i * o_plane.XAxis * x_dist + j * o_plane.YAxis * y_dist
        temp_pt += rg.Vector3d.ZAxis * r.randint(0,60)
        way_pts.append(temp_pt)
        waiting_times.append(r.uniform(0.5,5.0))
# ---------- end python ----------
crv = Curve(<curve referenced from the Rhino model>)
list_5 = ValueList({"no_tool": 0, "spray_gun": 1, "extruder": 2}, selected="extruder")
divide = DivideCurve(Curve=crv, Count=10, Kinks=False)  # -> Points, Tangents, Parameters
panel_5 = Panel(python.waiting_times)
tools_3 = Tools_3(tool_id=list_5)
pt = Point(python.way_pts)
xy_2 = XYPlane(Origin=divide.Points)
xy_3 = XYPlane(Origin=pt)
python_2 = GhPythonScript(x=tools)  # -> out, a
# ---------- python_2: Python ----------
__author__ = "jesusm"
__version__ = "2018.09.27"

import rhinoscriptsyntax as rs

print x.model
# ---------- end python_2 ----------
deplane = DeconstructPlane(Plane=xy_2)  # -> Origin, XAxis, YAxis, ZAxis

# ----
# Executing
panel_6 = Panel("Start communication server")
py_3 = PythonScript()  # -> path
# ---------- py_3: Python ----------
import sys
import os

ghComp = ghenv.Component
ghDoc = ghComp.OnPingDocument()

# the full path of the gh file
path = ghDoc.FilePath
# the directory of the gh file
path = os.path.dirname(path)

path = os.path.abspath(os.path.join(path, ".."))

print path
# ---------- end py_3 ----------
panel_7 = Panel(py_3)
start = Button()
server = PythonScript(path=panel_7, start=start)
# ---------- server: Python ----------
import os
import threading
from scriptcontext import sticky as st

server_address = st["server_address"]
server_port = st["server_port"]
ur_ip = st["ur_ip"]

"""
Change main!!!!
"""
main = os.path.join(path, "communication", "main_ita_elective.py")

if os.path.isfile(main):
        
    def myfunc():
        syscall = "python %s %s %s %s" % (main, server_address, server_port, ur_ip)
        os.system(syscall)
    
    if start:
        t = threading.Thread(target=myfunc)
        t.start()
# ---------- end server ----------

rot3d = Rotate3D(Geometry=xy_2, Angle=degrees(Slider(180, range=0..1000)), Center=deplane.Origin, Axis=deplane.XAxis)  # -> Geometry, Transform
loop_count = PythonScript(planes=xy_3, cnt=Slider(1, range=1..10))  # -> many_planes; inputs planes: list, cnt: Int32
# ---------- loop_count: Python ----------
many_planes = []

for i in range(cnt):
    many_planes.extend(_planes)
# ---------- end loop_count ----------
speed = Slider(22, range=0..300)

# ---- group: Define commands
python_3 = PythonScript(planes_WCS=loop_count, dfillet=Slider(20, range=0..100), speed=speed)  # -> commands; inputs planes_WCS: list, speed: Int32
# ---------- python_3: Python ----------
import Rhino.Geometry as rg
from compas.geometry import Frame
from compas.geometry import Transformation
from compas_ghpython import xdraw_frame
from scriptcontext import sticky as st

robot = st["robot"]
buffer = 0.7

# TODO this must be optimized! matrix multiplication!
commands = []
for i, plane_WCS in enumerate(planes_WCS):
    tcp_WCS = Frame(plane_WCS.Origin, plane_WCS.XAxis, plane_WCS.YAxis)
    if i == 0 or i == len(planes_WCS) - 1:
        radius = 0.
        
    else:
        # calculate blend radius
        prev, current, next = planes_WCS[i-1].Origin, planes_WCS[i].Origin, planes_WCS[i+1].Origin
        radius = min((prev - current).Length/2 * buffer, (next - current).Length/2 * buffer, dfillet)
    
    tcp_RCS = robot.get_frame_in_RCS(tcp_WCS)
    
    cmd = list(tcp_RCS.point) + tcp_RCS.axis_angle_vector + [speed, radius]
    #cmd = list(tcp_RCS.point) + tcp_RCS.axis_angle_vector + [time, radius]
    commands.append(cmd)
    
    
    
print (commands)
# ---------- end python_3 ----------

# ----
start_2 = Button()
py_4 = PythonScript()  # -> path; same code as py_3
# 1
# Executing
panel_8 = Panel("Start communication server")
panel_9 = Panel(py_4)
server_2 = PythonScript(path=panel_9, start=start_2)
# ---------- server_2: Python ----------
import os
import threading
from scriptcontext import sticky as st

server_address = st["server_address"]
server_port = st["server_port"]
ur_ip = st["ur_ip"]

"""
Change main!!!!
"""
main = os.path.join(path, "communication", "main.py")

if os.path.isfile(main):
        
    def myfunc():
        syscall = "python %s %s %s %s" % (main, server_address, server_port, ur_ip)
        os.system(syscall)
    
    if start:
        t = threading.Thread(target=myfunc)
        t.start()
# ---------- end server_2 ----------

# ----
# 2
panel_10 = Panel("Get UR connected")
ur = PythonScript(send=start)
# ---------- ur: Python ----------
from scriptcontext import sticky as st
from ur_online_control.ur_driver import URDriver

server_address = st["server_address"]
server_port = st["server_port"]
ur_ip = st["ur_ip"]
robot = st["robot"]

tool_angle_axis = list(robot.tool.tcp_frame.point) + robot.tool.tcp_frame.axis_angle_vector
#robot.tool.tcp_frame.pose_axis_angle_vector
print tool_angle_axis

ur_driver = URDriver(server_address, server_port, tool_angle_axis, ur_ip, "UR")
print ur_driver

if send:
    ur_driver.send()
# ---------- end ur ----------

entryexitpt = PythonScript(planes=loop_count, safety_distance=Slider(15, range=0..100))  # -> commands, planes; inputs planes: list
# ---------- entryexitpt: Python ----------
import Rhino.Geometry as rg
from scriptcontext import sticky as st
from compas.geometry import Frame

robot = st["robot"]

in_plane = _planes[0]
out_plane = _planes[-1]

safe_in_plane = rg.Plane(in_plane)
safe_out_plane = rg.Plane(out_plane)

### safe_in_plane XX mm above start ####
safe_in_plane.Translate(rg.Vector3d(0,0,safety_distance))
safe_in_frame_WCS = Frame(safe_in_plane.Origin, safe_in_plane.XAxis, safe_in_plane.YAxis)
safe_in_frame_RCS = robot.get_frame_in_RCS(safe_in_frame_WCS)

### in_plane ###
in_frame_WCS = Frame(in_plane.Origin, in_plane.XAxis, in_plane.YAxis)
in_frame_RCS = robot.get_frame_in_RCS(in_frame_WCS)

### out_plane ###
out_frame_WCS = Frame(out_plane.Origin, out_plane.XAxis, out_plane.YAxis)
out_frame_RCS = robot.get_frame_in_RCS(out_frame_WCS)

### safe_out_plane XX mm above start ####
safe_out_plane.Translate(rg.Vector3d(0,0,safety_distance))
safe_out_frame_WCS = Frame(safe_out_plane.Origin, safe_out_plane.XAxis, safe_out_plane.YAxis)
safe_out_frame_RCS = robot.get_frame_in_RCS(safe_out_frame_WCS)

planes = safe_in_plane, in_plane, out_plane, safe_out_plane

acc = 100
vel = 30

commands = []
commands.append(list(safe_in_frame_RCS.point) + safe_in_frame_RCS.axis_angle_vector + [acc, vel])
commands.append(list(in_frame_RCS.point) + in_frame_RCS.axis_angle_vector + [acc, vel])

commands.append(list(out_frame_RCS.point) + out_frame_RCS.axis_angle_vector + [acc, vel])
commands.append(list(safe_out_frame_RCS.point) + safe_out_frame_RCS.axis_angle_vector + [acc, vel])

print commands
# ---------- end entryexitpt ----------
pt_2 = Point(Point(275.3261675, 452.7964501, 294.3193763))
crv_2 = Curve(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)
xy_4 = XYPlane(Origin=pt_2)
pframes = PerpFrames(Curve=crv_2, Count=10, Align=True)  # -> Frames, Parameters

# ---- group: Define commands
speed_2 = Slider(50, range=0..300)
# 2
number_slider = Slider(15, range=0..100)
planes_wcs = Plane(pframes.Frames)
python_4 = PythonScript(planes_WCS=planes_wcs, dfillet=number_slider, speed=speed_2, safe_pt=xy_4)  # -> commands; inputs planes_WCS: list of Plane, speed: Int32, safe_pt: Plane
# ---------- python_4: Python ----------
import Rhino.Geometry as rg
from compas.geometry import Frame
from compas.geometry import Transformation
from compas_ghpython import xdraw_frame
from scriptcontext import sticky as st

robot = st["robot"]
buffer = 0.7

commands = []

# add safe_pt as a starting point
tcp_WCS_safe_pt = Frame(safe_pt.Origin, safe_pt.XAxis, safe_pt.YAxis)

tcp_RCS_safe_pt = robot.get_frame_in_RCS(tcp_WCS_safe_pt)
cmd_safe_pt = list(tcp_RCS_safe_pt.point) + tcp_RCS_safe_pt.axis_angle_vector + [speed, 0]
print cmd_safe_pt
commands.append(cmd_safe_pt)

# TODO this must be optimized! matrix multiplication!

for i, plane_WCS in enumerate(planes_WCS):
    tcp_WCS = Frame(plane_WCS.Origin, plane_WCS.XAxis, plane_WCS.YAxis)
    if i == 0 or i == len(planes_WCS) - 1:
        radius = 0.
        
    else:
        # calculate blend radius
        prev, current, next = planes_WCS[i-1].Origin, planes_WCS[i].Origin, planes_WCS[i+1].Origin
        radius = min((prev - current).Length/2 * buffer, (next - current).Length/2 * buffer, dfillet)
    
    tcp_RCS = robot.get_frame_in_RCS(tcp_WCS)
    cmd = list(tcp_RCS.point) + tcp_RCS.axis_angle_vector + [speed, radius]
    commands.append(cmd)


# add safe_pt as an end point
commands.append(cmd_safe_pt)
print (commands)
# ---------- end python_4 ----------

# ----
disconnect = Button()
# 3
panel_11 = Panel("Get Grasshopper connected")
client = PythonScript(connect=start, disconnect=disconnect)  # -> connected, client
# ---------- client: Python ----------
import time
from scriptcontext import sticky as st
from Rhino.RhinoApp import WriteLine
from ur_online_control.grasshopper import GHClient, gh_component_timer
import time

server_address = st["server_address"]
server_port = st["server_port"]

guid = str(ghenv.Component.InstanceGuid)

client_key = "client_" + guid
run_key = "run_" + guid

if connect:
    if client_key not in st:
        st[client_key] = GHClient(server_address, server_port)
        client = st[client_key]
        client.connect_to_server()
        client.start()
        
    else:
        if st[client_key].running:
            WriteLine("Client is already connected.")
            
        else:
            st[client_key] = GHClient(server_address, server_port)
            client = st[client_key]
            client.connect_to_server()
            client.start()
"""
else:
    if client_key in st:
        # we need a timer to ask if we have something on the rcv queue
        client = st[client_key]
        #if client.running:
        #    #client.run_inner_while()
        #    gh_component_timer(ghenv, True, 1000)
"""

if disconnect:
    if client_key in st:
        client = st[client_key]
        if client.running:
            client.close()

if client_key in st:
    connected =  st[client_key].running
    client = st[client_key]
    print st[client_key].rcv_queue.qsize()
    print st[client_key].snd_queue.qsize()
else:
    connected = False
# ---------- end client ----------
panel_12 = Panel(client.connected)

continue_fabrication = BooleanToggle(True)
send = Button()
commands = Data(python_3)
panel_13 = Panel("Send a message")
send_2 = PythonScript(
    client=client.client,
    send=send,
    continue_fabrication=continue_fabrication,
    in_out_cmd=entryexitpt.commands,
    tool=tools,
    commands=commands)  # -> out; inputs continue_fabrication: Int32, in_out_cmd: list, commands: list
# ---------- send_2: Python ----------
from ur_online_control.communication.msg_identifiers import *
from ur_online_control.utilities.lists import flatten_list

len_command = len(commands[0])
commands_flattened = flatten_list(commands)

safe_in_pose_cmd, in_pose_cmd, out_pose_cmd, safe_out_pose_cmd = in_out_cmd

sand_tool = tool
sand_tool_axis = list(sand_tool.tcp_frame.point) + sand_tool.tcp_frame.axis_angle_vector


### Gravel placment ###
"""
#safe_in_pose_gravel, safe_out_pose_gravel = cmd_gravel_in_out 
pose_gravel = cmd_gravel
"""
if send and client:
    ### string_fabrication ###
    client.send(MSG_INT, int(continue_fabrication))
    client.send(MSG_FLOAT_LIST, sand_tool_axis) ### set string_tcp ###
    client.send(MSG_FLOAT_LIST, safe_in_pose_cmd)
    #client.send(MSG_FLOAT_LIST, waiting_times)
    client.send(MSG_INT, len_command)
    client.send(MSG_FLOAT_LIST, commands_flattened)
    client.send(MSG_FLOAT_LIST, safe_out_pose_cmd)
# ---------- end send_2 ----------

panel_14 = Panel("Get UR connected")
ur_2 = PythonScript(send=start_2)  # same code as ur

bang_3 = Button()
receive = PythonScript(client=client.client, bang=bang_3)  # -> qsize, client
# ---------- receive: Python ----------
from ur_online_control.communication.msg_identifiers import *
from ur_online_control.utilities.lists import flatten_list
from Rhino.RhinoApp import WriteLine


if client:
    if not client.ghenv:
        client.ghenv = ghenv
    qsize = client.rcv_queue.qsize()
# ---------- end receive ----------

disconnect_2 = Button()
panel_15 = Panel("Get Grasshopper connected")
client_2 = PythonScript(connect=start_2, disconnect=disconnect_2)  # -> connected, client; same code as client
panel_16 = Panel(client_2.connected)

panel_17 = Panel(receive.qsize)
send_3 = PythonScript(client=receive.client)  # -> out
# ---------- send_3: Python ----------
from ur_online_control.communication.msg_identifiers import *
from ur_online_control.utilities.lists import flatten_list

if client:
    qsize = client.rcv_queue.qsize()
    if qsize:
        msg = client.rcv_queue.get()
        print msg
# ---------- end send_3 ----------

# ----
# This component updates on receive
bang_4 = Button()
receive_2 = PythonScript(client=client_2.client, bang=bang_4)  # -> qsize, client; same code as receive
panel_18 = Panel(receive_2.qsize)

# ----
# 4
panel_19 = Panel(send_2)
move_safe_pt = BooleanToggle(False)

continue_fabrication_2 = BooleanToggle(True)
# 3
panel_20 = Panel("Send a message")
send_4 = Button()
commands_2 = Data(python_4)
send_5 = PythonScript(
    client=client_2.client,
    send=send_4,
    continue_fabrication=continue_fabrication_2,
    commands=commands_2,
    move_safe_pt=move_safe_pt)  # -> out; inputs continue_fabrication: Int32, commands: list, move_safe_pt: Boolean
# ---------- send_5: Python ----------
from ur_online_control.communication.msg_identifiers import *
from ur_online_control.utilities.lists import flatten_list

len_command = len(commands[0])
commands_flattened = flatten_list(commands)

print len(commands_flattened)/8

#picking_pose_cmd, savety_pose_cmd = picking_commands

#print picking_pose_cmd
#print savety_pose_cmd

if send and client:
    client.send(MSG_INT, int(continue_fabrication))
 #   client.send(MSG_FLOAT_LIST, picking_pose_cmd)
 #   client.send(MSG_FLOAT_LIST, savety_pose_cmd)
    client.send(MSG_INT, len_command)
    client.send(MSG_FLOAT_LIST, commands_flattened)
    client.send(MSG_INT, move_safe_pt)
# ---------- end send_5 ----------

panel_21 = Panel(send_3)
send_6 = PythonScript(client=receive_2.client)  # -> out; same code as send_3
panel_22 = Panel(send_5)
panel_23 = Panel(send_6)
# Visualisation
robot_3 = Data(robot)
planes_wcs_2 = Plane(xy_3)

# ----
# Direct UR control
get = Button()
get_2 = Button()
pose = PythonScript(get=get_2)  # -> pose_joints
# ---------- pose: Python ----------
from scriptcontext import sticky as st
from ur_online_control.ur_direct import get_current_pose_joints

server_address = st["server_address"]
server_port = 30005
ur_ip = st["ur_ip"]
robot = st["robot"]
tool_angle_axis = list(robot.tool.tcp_frame.point) + robot.tool.tcp_frame.axis_angle_vector
print tool_angle_axis

guid = str(ghenv.Component.InstanceGuid)
pose_joints_key = "pose_joints" + guid


if get:
    st[pose_joints_key] = get_current_pose_joints(server_address, server_port, ur_ip, tool_angle_axis)
    
if pose_joints_key not in st:
    pose_joints = []
else:
    pose_joints = st[pose_joints_key]
# ---------- end pose ----------
pose_2 = PythonScript(get=get)  # -> pose_cartesian
# ---------- pose_2: Python ----------
from scriptcontext import sticky as st
from ur_online_control.ur_direct import get_current_pose_cartesian

server_address = st["server_address"]
server_port = 30005
ur_ip = st["ur_ip"]
robot = st["robot"]
tool_angle_axis = list(robot.tool.tcp_frame.point) + robot.tool.tcp_frame.axis_angle_vector
print tool_angle_axis

guid = str(ghenv.Component.InstanceGuid)
pose_cartesian_key = "pose_cartesian" + guid


if get:
    st[pose_cartesian_key] = get_current_pose_cartesian(server_address, server_port, ur_ip, tool_angle_axis)

if pose_cartesian_key not in st:
    pose_cartesian = []
else:
    pose_cartesian = st[pose_cartesian_key]
# ---------- end pose_2 ----------
stop = Button()
stop_2 = PythonScript(stop=stop)
# ---------- stop_2: Python ----------
from scriptcontext import sticky as st
from ur_online_control.ur_direct import stop as stop_robot

ur_ip = st["ur_ip"]

if stop:
    stop_robot(ur_ip)
# ---------- end stop_2 ----------
panel_24 = Panel(pose)
panel_25 = Panel(pose_2)

pose_joints = Data(pose)

# ---- group: Calculate joint positions for path
# Add init joint states
joint_states = Data([-0.1728179112, -1.415058186, 1.813991282, -1.971940356, -1.571654205, -3.308720436])
init_configuration = Slider(2, range=0..7)
py_5 = PythonScript(robot=robot_3, planes_WCS=planes_wcs_2, configuration_idx=init_configuration, init_configuration=joint_states)  # -> configurations; inputs planes_WCS: list, configuration_idx: Int32, init_configuration: list
# ---------- py_5: Python ----------
from compas_ghpython import unload_modules
unload_modules('ur_online_control')
import Rhino.Geometry as rg
from compas.geometry import Frame 
from compas.geometry.xforms import Transformation
from compas_ghpython import xdraw_frame
from ur_online_control.ur.kinematics import calculate_configurations_for_path, format_joint_positions


# TODO this must be optimized! matrix multiplication!
frames_tool0_RCS = []
for plane_WCS in planes_WCS:
    tcp_WCS = Frame(plane_WCS.Origin, plane_WCS.XAxis, plane_WCS.YAxis)
    tcp_RCS = robot.get_frame_in_RCS(tcp_WCS)
    frames_tool0_RCS.append(robot.get_tool0_frame_from_tcp_frame(tcp_RCS))
    

#configurations = calculate_configurations_for_path(frames_tool0_RCS, robot.params, init_configuration)
configurations = calculate_configurations_for_path(frames_tool0_RCS, robot, init_configuration)
print configurations
configurations = configurations[min([configuration_idx, len(configurations) - 1])]

def format(numbers, k=4):
    #numbers = format_joint_positions(numbers)
    return "[" + ", ".join([("%." + str(k) + "f") % n for n in numbers]) + "]"
# ---------- end py_5 ----------
start_3 = Button()
stop_3 = Button()
step = Button()
counter = CountThroughList(L=py_5, start=start_3, stop=stop_3, step=step, interval=100)  # -> item; inputs L: list, start: Boolean, stop: Boolean
# ---------- counter: Python ----------
from scriptcontext import sticky as st
from compas_ghpython import update_component


# store data in component
guid = str(ghenv.Component.InstanceGuid)
counter_key = "counter_" + guid
running_key = "running_" + guid

if counter_key not in st:
    st[counter_key] = 0

if running_key not in st:
    st[running_key] = False

if start:
    st[running_key] = True

if stop:
    st[running_key] = False

if step:
    if st[counter_key] < len(L) - 1:
        st[counter_key] += 1
    
if len(L):
    item = L[st[counter_key]]

if st[running_key]:
    if st[counter_key] < len(L) - 1:
        st[counter_key] += 1
        update_component(ghenv, interval)
    else:
        st[counter_key] = 0
        st[running_key] = False
# ---------- end counter ----------

# ----
vertical_pose = Number([-152.427, -780.635, 855.229, -1.1958, -1.22046, -1.20201])
py_6 = PythonScript(pose_cartesian=pose_2)  # -> frame_WCS; inputs pose_cartesian: list
# ---------- py_6: Python ----------
import Rhino.Geometry as rg
from scriptcontext import sticky as st
from compas.geometry import Frame
from compas.geometry.xforms import Transformation

robot = st["robot"]

if pose_cartesian:
    frame_RCS = Frame.from_pose_axis_angle_vector(pose_cartesian)
    frame_WCS = robot.get_frame_in_WCS(frame_RCS)
    
    print frame_WCS
# ---------- end py_6 ----------

# ---- group: Define plane in WCS, calculate joint positions
pt_3 = Point(Point(-283.8412985, -342.877576, 297.4189147))
select_configuration = Slider(2, range=0..7)
xy_5 = XYPlane(Origin=pt_3)
plane_wcs = Plane(xy_5)
inverse = PythonScript(robot=robot_3, plane_WCS=plane_wcs, idx=select_configuration)  # -> configuration; inputs plane_WCS: Plane, idx: Int32
# ---------- inverse: Python ----------
import Rhino.Geometry as rg
from compas.geometry import Frame, Transformation
from compas_ghpython import xdraw_frame

tcp_WCS = Frame(plane_WCS.Origin, plane_WCS.XAxis, plane_WCS.YAxis)

# transform frame to robot coordinate system
tcp_RCS = robot.get_frame_in_RCS(tcp_WCS)

# get the frame of tool0
tool0_RCS = robot.get_tool0_frame_from_tcp_frame(tcp_RCS)

# calculate solutions to frame
solutions = robot.inverse_kinematics(tool0_RCS)

if not len(solutions):
    q = [0,0,0,0,0,0]
else:
    idx = min(len(solutions) - 1, idx)
    q = solutions[idx]
    
print q

configuration = q
# ---------- end inverse ----------

# ----
# Direct UR control
get_3 = Button()
get_4 = Button()
pose_3 = PythonScript(get=get_4)  # -> pose_joints
# ---------- pose_3: Python ----------
from scriptcontext import sticky as st
from ur_online_control.ur_direct import get_current_pose_joints
from ur_online_control.ur.robot import BaseConfiguration

server_address = st["server_address"]
server_port = 30005
ur_ip = st["ur_ip"]
robot = st["robot"]
tool_angle_axis = list(robot.tool.tcp_frame.point) + robot.tool.tcp_frame.axis_angle_vector
print tool_angle_axis

guid = str(ghenv.Component.InstanceGuid)
pose_joints_key = "pose_joints" + guid


if get:
    st[pose_joints_key] = get_current_pose_joints(server_address, server_port, ur_ip, tool_angle_axis)
    
if pose_joints_key not in st:
    pose_joints = []
else:
    pose_joints = BaseConfiguration.from_joints(st[pose_joints_key])
# ---------- end pose_3 ----------
pose_4 = PythonScript(get=get_3)  # -> pose_cartesian; same code as pose_2
stop_4 = Button()
stop_5 = PythonScript(stop=stop_4)  # same code as stop_2
panel_26 = Panel(pose_3)
panel_27 = Panel(pose_4)

# ----
# Visualisation
crv_3 = Curve(crv)
divide_2 = DivideCurve(Curve=crv_3, Count=10, Kinks=False)  # -> Points, Tangents, Parameters
xy_6 = XYPlane(Origin=divide_2.Points)
pose_joints_2 = Data(pose_3)
robot_4 = Data(robot_2)
planes_wcs_3 = Plane(planes_wcs)

# ---- group: Calculate joint positions for path / Shows joint positions along path
flip = BooleanToggle(True)
l2t = PythonScript(L=py_5, flip=flip)  # -> T; inputs L: list, flip: Boolean
# ---------- l2t: Python ----------
from compas_ghpython import list_to_ghtree
L = [l.joint_values for l in L]

if flip:
    L = zip(*L)
T = list_to_ghtree(L)
# ---------- end l2t ----------
graph = QuickGraph(l2t, SortOrder=0)

# ----
draw = Draw(frame=py_6)  # -> G, C
vertical_pose_2 = Number([-152.427, -780.635, 855.229, -1.1958, -1.22046, -1.20201])
preview = CustomPreview(Geometry=draw.G, Shader=draw.C)
py_7 = PythonScript(pose_cartesian=pose_4)  # -> frame_WCS; inputs pose_cartesian: list; same code as py_6

# ---- group: Define joint positions
base_3 = Slider(-11.504, range=-360..360)
elbow = Slider(83.471, range=-360..360)
wrist2 = Slider(-95.604, range=-360..360)
wrist3 = Slider(-76.702, range=-360..360)
shoulder = Slider(-80.854, range=-360..360)
wrist1 = Slider(-78.959, range=-360..360)
ur1_q1_q6 = Data([base_3, shoulder, elbow, wrist1, wrist2, wrist3])

# ---- group: Define plane in WCS, calculate joint positions
pt_4 = Point(Point(-283.8412985, -342.877576, 297.4189147))
select_configuration_2 = Slider(1, range=0..7)
xy_7 = XYPlane(Origin=pt_4)
plane_wcs_2 = Plane(xy_7)
inverse_2 = PythonScript(robot=robot_4, plane_WCS=plane_wcs_2, idx=select_configuration_2)  # -> configuration; inputs plane_WCS: Plane, idx: Int32; same code as inverse

# ----
py_8 = GhPythonScript(joint_values=ur1_q1_q6)  # -> configuration; inputs joint_values: list
# ---------- py_8: Python ----------
import math
from ur_online_control.ur.robot import BaseConfiguration

configuration = BaseConfiguration.from_joints([math.radians(d) for d in joint_values])
# ---------- end py_8 ----------

# ----
# Calculate basis
# Measure basis:
# 1. Clear the recorded poses
# 2. Move robot to origin and press "get pose"
# 3. Move robot to point in positive x-axis and press "get pose"
# 4. Move robot to an other point in your basis and press "get pose"
# (The farer away these positions are, the better)
# 
# 5. Alternatively change the order in the component calc base
# 6. Copy output into base component
clear = Button()
list_6 = ValueList({"origin, pt on positive x-axis, pt in xy plane": 0, "origin, pt on positive y-axis, pt in xy plane": 1}, selected="origin, pt on positive x-axis, pt in xy plane")
rec = PythonScript(msg=pose_2, rec=get, clear=clear)  # -> rec; inputs msg: list
# ---------- rec: Python ----------
from scriptcontext import sticky as st

guid = str(ghenv.Component.InstanceGuid)
recorded_key =  "recorded_" + guid
just_cleared_key = "just_cleared_" + guid

if recorded_key not in st:
    st[recorded_key] = []

if just_cleared_key not in st:
    st[just_cleared_key] = False

if clear:
    st[recorded_key] = []
    st[just_cleared_key] = True
else:
    if len(msg):
        if msg != [None] and not st[just_cleared_key] and rec:
            st[recorded_key].append(msg)
    st[just_cleared_key] = False
        


rec = st[recorded_key]

print rec
# ---------- end rec ----------
calc_base = PythonScript(poses=rec, input_type=list_6)  # -> out; inputs poses: list
# ---------- calc_base: Python ----------
import Rhino.Geometry as rg
import math


if len(poses) > 2:
    
    O = poses[0]
    P1 = poses[1]
    P2 = poses[2]
    
    if input_type == 0:
        # origin, pt on positive x-axis, pt in xy plane
        origin = rg.Point3d(O[0], O[1], O[2])
        pt_on_xaxis = rg.Point3d(P1[0], P1[1], P1[2])
        pt_in_xyplane = rg.Point3d(P2[0], P2[1], P2[2])
        
        xaxis = pt_on_xaxis - origin
        xaxis.Unitize()
        
        v = pt_in_xyplane - origin
        zaxis = rg.Vector3d.CrossProduct(v, xaxis)
        zaxis.Unitize()
        
        # zaxis must look up!
        if math.acos(rg.Vector3d.ZAxis * zaxis) > math.acos(rg.Vector3d.ZAxis * -zaxis):
            zaxis = -zaxis
        
        yaxis = rg.Vector3d.CrossProduct(zaxis, xaxis)
    
    elif input_type == 1:
        # origin, pt on positive y-axis, pt in xy plane
        origin = rg.Point3d(O[0], O[1], O[2])
        pt_on_yaxis = rg.Point3d(P1[0], P1[1], P1[2])
        pt_in_xyplane = rg.Point3d(P2[0], P2[1], P2[2])
        
        yaxis = pt_on_yaxis - origin
        yaxis.Unitize()
        
        v = pt_in_xyplane - origin
        zaxis = rg.Vector3d.CrossProduct(v, yaxis)
        zaxis.Unitize()
        
        # zaxis must look up!
        if math.acos(rg.Vector3d.ZAxis * zaxis) > math.acos(rg.Vector3d.ZAxis * -zaxis):
            zaxis = -zaxis
        
        xaxis = rg.Vector3d.CrossProduct(yaxis, zaxis)
        
        
    print "Copy the following into base component:"
    print " "
    print "origin = [%.2f, %.2f, %.2f]" % tuple(list(origin))
    print "xaxis = [%.5f, %.5f, %.5f]" % tuple(list(xaxis))
    print "yaxis = [%.5f, %.5f, %.5f]" % tuple(list(yaxis))
    

#print rg.Vector3d.CrossProduct(rg.Vector3d.YAxis, rg.Vector3d.ZAxis)
#print rg.Vector3d.CrossProduct(rg.Vector3d.ZAxis, rg.Vector3d.XAxis)
# ---------- end calc_base ----------
panel_28 = Panel(rec)
panel_29 = Panel(calc_base)

draw_2 = Draw(frame=py_7)  # -> G, C
back = Button()
reset = Button()

# ---- group: Calculate joint positions for path
# Add init joint states
joint_states_2 = Data([-0.1728179112, -1.415058186, 1.813991282, -1.971940356, -1.571654205, -3.308720436])
init_configuration_2 = Slider(0, range=0..7)
py_9 = PythonScript(robot=robot_4, planes_WCS=planes_wcs_3, configuration_idx=init_configuration_2, init_configuration=joint_states_2)  # -> configurations; inputs planes_WCS: list, configuration_idx: Int32, init_configuration: list; same code as py_5
start_4 = Button()
stop_6 = Button()
step_2 = Button()
counter_2 = CountThroughList(L=py_9, start=start_4, stop=stop_6, step=step_2, step_back=back, reset=reset, interval=100)  # -> item; inputs L: list, start: Boolean, stop: Boolean, step_back: Boolean
# ---------- counter_2: Python ----------
from scriptcontext import sticky as st
from compas_ghpython import update_component


# store data in component
guid = str(ghenv.Component.InstanceGuid)
counter_key = "counter_" + guid
running_key = "running_" + guid

if counter_key not in st:
    st[counter_key] = 0

if running_key not in st:
    st[running_key] = False

if start:
    st[running_key] = True

if stop:
    st[running_key] = False

if step:
    if st[counter_key] < len(L) - 1:
        st[counter_key] += 1

if step_back:
    if st[counter_key] < len(L) - 1:
        st[counter_key] -= 1

if reset:
    st[counter_key] = 0

if len(L):
    item = L[st[counter_key]]

if st[running_key]:
    if st[counter_key] < len(L) - 1:
        st[counter_key] += 1
        update_component(ghenv, interval)
    else:
        st[counter_key] = 0
        st[running_key] = False
# ---------- end counter_2 ----------

# ---- group: Calculate joint positions for path / Shows joint positions along path
flip_2 = BooleanToggle(True)
l2t_2 = PythonScript(L=py_9, flip=flip_2)  # -> T; inputs L: list, flip: Boolean; same code as l2t
graph_2 = QuickGraph(l2t_2, SortOrder=0)

# ----
preview_2 = CustomPreview(Geometry=draw_2.G, Shader=draw_2.C)

# ---- group: Define joint positions
base_4 = Slider(90.163, range=-360..360)
shoulder_2 = Slider(0, range=-360..360)
elbow_2 = Slider(-102.857, range=-360..360)
wrist1_2 = Slider(0, range=-360..360)
wrist2_2 = Slider(0, range=-360..360)
wrist3_2 = Slider(0, range=-360..360)
ur1_q1_q6_2 = Data([base_4, shoulder_2, elbow_2, wrist1_2, wrist2_2, wrist3_2])

# ---- group: Visualise / robot model brep
py_10 = PythonScript(model=list_2)  # -> n
# ---------- py_10: Python ----------
if model == "UR5":
    n = 0
if model == "UR10":
    n = 1

print n
# ---------- end py_10 ----------
ur10_brep = UR10Brep([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])
ur5_brep = UR5Brep([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])
show_brep = BooleanToggle(False)
filter = StreamFilter(Gate=py_10, Stream0=ur5_brep, Stream1=ur10_brep)

# ---- group: Visualise
list_7 = ValueList({"0 forward, from angles": 0, "1 inverse, from one plane": 1, "2 inverse, from multiple planes": 2, "3 forward, from robot": 3}, selected="0 forward, from angles")
filter_2 = StreamFilter(Gate=list_7, Stream0=py_8, Stream1=inverse, Stream2=counter, Stream3=pose_joints)
configuration = Panel(filter_2)
mesh = Mesh(filter)
draw_3 = PythonScript(robot=robot_3, configuration=filter_2, mesh=mesh, brep=filter, show_brep=show_brep)  # -> meshes, tool0_plane, tcp_plane, robot_brep; inputs mesh: list, brep: list
# ---------- draw_3: Python ----------
from compas_ghpython import unload_modules
unload_modules("ur_online_control")

from compas_ghpython import xdraw_frame
from compas_ghpython import mesh_draw
from compas_ghpython.geometry.xforms import xform_from_transformation
from compas.geometry import Frame
from compas.geometry.xforms import Transformation
from ur_online_control.ur.robot import BaseConfiguration

import Rhino.Geometry as rg
import Rhino

def mesh_update_vertices(mesh, vertices):
    for i in range(len(vertices)):
        mesh.vertex[i].update({'x': vertices[i][0], 'y': vertices[i][1], 'z': vertices[i][2]})

if configuration:
    #print configuration
    #q = BaseConfiguration.from_joints(configuration)
    q = configuration
    print q
    print q.joint_values
    
    print robot.get_forward_transformations(q)
    R0, R1, R2, R3, R4, R5 = robot.get_forward_transformations(q)
    
    tool0_frame2 = robot.tool0_frame.transformed(R5)
    tcp_frame2 = Frame.from_transformation(Transformation.from_frame(tool0_frame2) * robot.transformation_tool0_tcp)
    
    print robot.transformation_tool0_tcp
    print robot.transformation_tcp_tool0
    print robot.transformation_tool0_tcp * robot.transformation_tcp_tool0
    print tcp_frame2
    tcp_frame2 = Frame.from_transformation(Transformation.from_frame(tool0_frame2) * robot.transformation_tcp_tool0)
    print tcp_frame2

    tool0_frame, tcp_frame = robot.get_transformed_tool_frames(R5)
    
    tool0_frame = tool0_frame2
    tcp_frame = tcp_frame2
    
    m0, m1, m2, m3, m4, m5 = mesh
    for i in range(6):
        exec("R%drg = xform_from_transformation(R%d)" % (i, i))
        exec("m%d.Transform(R%drg)" % (i, i))
    meshes = [m0, m1, m2, m3, m4, m5]

    mt = robot.get_transformed_tool_model(Transformation.from_frame(tcp_frame))
    if mt:
        meshes.append(mesh_draw(mt))
    
    """
    m0, m1, m2, m3, m4, m5, tool0_frame, tcp_frame = robot.get_transformed_model(q)
    mt = robot.get_transformed_tool_model(tcp_frame)
    
    meshes = []
    meshes.append(mesh_draw(m0))
    meshes.append(mesh_draw(m1))
    meshes.append(mesh_draw(m2))
    meshes.append(mesh_draw(m3))
    meshes.append(mesh_draw(m4))
    meshes.append(mesh_draw(m5))
    if mt:
        meshes.append(mesh_draw(mt))
    
    """
    
    tool0_plane = xdraw_frame(tool0_frame)
    tcp_plane = xdraw_frame(tcp_frame)
    
    if show_brep:
        
        b0, b1, b2, b3, b4, b5 = brep
        
        b0.Transform(R0rg)
        b1.Transform(R1rg)
        b2.Transform(R2rg)
        b3.Transform(R3rg)
        b4.Transform(R4rg)
        b5.Transform(R5rg)
        
        robot_brep = [b0, b1, b2, b3, b4, b5]
# ---------- end draw_3 ----------
robot_brep = Brep(draw_3.robot_brep)
tcp_plane = Plane(draw_3.tcp_plane)
tool0_plane = Plane(draw_3.tool0_plane)
draw_4 = RepresentPlaneAsLines(plane=tcp_plane, size=100)  # -> G, C
# ---------- draw_4: Python ----------
import Rhino.Geometry as rg
from System.Drawing import Color

if plane:

    G = []
    G.append(rg.Line(plane.Origin, size * plane.XAxis))
    G.append(rg.Line(plane.Origin, size * plane.YAxis))
    G.append(rg.Line(plane.Origin, size * plane.ZAxis))
    
    C = []
    C.append(Color.FromArgb(255, 0, 0))
    C.append(Color.FromArgb(0, 255, 0))
    C.append(Color.FromArgb(0, 0, 255))
# ---------- end draw_4 ----------
preview_3 = CustomPreview(Geometry=draw_3.meshes, Shader=ColourSwatch(SwatchColor=RGBA(99, 94, 94, 96)))
preview_4 = CustomPreview(Geometry=draw_4.G, Shader=draw_4.C)

# ----
py_11 = GhPythonScript(joint_values=ur1_q1_q6_2)  # -> configuration; inputs joint_values: list; same code as py_8

# ----
# Calculate basis
list_8 = ValueList({"origin, pt on positive x-axis, pt in xy plane": 0, "origin, pt on positive y-axis, pt in xy plane": 1}, selected="origin, pt on positive x-axis, pt in xy plane")
clear_2 = Button()
rec_2 = PythonScript(msg=pose_4, rec=get_3, clear=clear_2)  # -> rec; inputs msg: list; same code as rec
calc_base_2 = PythonScript(poses=rec_2, input_type=list_8)  # -> out; inputs poses: list; same code as calc_base
panel_30 = Panel(rec_2)
panel_31 = Panel(calc_base_2)

# ---- group: Visualise / robot model brep
py_12 = PythonScript(model=list_4)  # -> n; same code as py_10
ur10_brep_2 = UR10Brep([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])
ur5_brep_2 = UR5Brep([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])
show_brep_2 = BooleanToggle(False)
filter_3 = StreamFilter(Gate=py_12, Stream0=ur5_brep_2, Stream1=ur10_brep_2)

# ---- group: Visualise
list_9 = ValueList({"0 forward, from angles": 0, "1 inverse, from one plane": 1, "2 inverse, from multiple planes": 2, "3 forward, from robot": 3}, selected="2 inverse, from multiple planes")
filter_4 = StreamFilter(Gate=list_9, Stream0=py_11, Stream1=inverse_2, Stream2=counter_2, Stream3=pose_joints_2)
configuration_2 = Panel(filter_4)
mesh_2 = Mesh(filter_3)
draw_5 = PythonScript(robot=robot_4, configuration=filter_4, mesh=mesh_2, brep=filter_3, show_brep=show_brep_2)  # -> meshes, tool0_plane, tcp_plane, robot_brep; inputs mesh: list, brep: list
# ---------- draw_5: Python ----------
from compas_ghpython import unload_modules
unload_modules("ur_online_control")

from compas_ghpython import xdraw_frame
from compas_ghpython import mesh_draw
from compas_ghpython.geometry.xforms import xform_from_transformation
from compas.geometry import Frame
from compas.geometry.xforms import Transformation
from ur_online_control.ur.robot import BaseConfiguration

import Rhino.Geometry as rg
import Rhino

def mesh_update_vertices(mesh, vertices):
    for i in range(len(vertices)):
        mesh.vertex[i].update({'x': vertices[i][0], 'y': vertices[i][1], 'z': vertices[i][2]})

if configuration:
    #print configuration
    #q = BaseConfiguration.from_joints(configuration)
    q = configuration
    print q
    print q.joint_values
    
    print robot.get_forward_transformations(q)
    R0, R1, R2, R3, R4, R5 = robot.get_forward_transformations(q)
    
    tool0_frame2 = robot.tool0_frame.transformed(R5)
    tcp_frame2 = Frame.from_transformation(Transformation.from_frame(tool0_frame2) * robot.transformation_tool0_tcp)
    
    print robot.transformation_tool0_tcp
    print robot.transformation_tcp_tool0
    print robot.transformation_tool0_tcp * robot.transformation_tcp_tool0
    print tcp_frame2
    tcp_frame2 = Frame.from_transformation(Transformation.from_frame(tool0_frame2) * robot.transformation_tcp_tool0)
    print tcp_frame2
    
    tool0_frame, tcp_frame = robot.get_transformed_tool_frames(R5)
    
    tool0_frame = tool0_frame2
    tcp_frame = tcp_frame2
    
    m0, m1, m2, m3, m4, m5 = mesh
    for i in range(6):
        exec("R%drg = xform_from_transformation(R%d)" % (i, i))
        exec("m%d.Transform(R%drg)" % (i, i))
    meshes = [m0, m1, m2, m3, m4, m5]
    print meshes
    mt = robot.tool.get_transformed_model(Transformation.from_frame(tool0_frame))
    
    if mt:
        meshes.extend(map(mesh_draw, mt))
    
    """
    m0, m1, m2, m3, m4, m5, tool0_frame, tcp_frame = robot.get_transformed_model(q)
    mt = robot.get_transformed_tool_model(tcp_frame)
    
    meshes = []
    meshes.append(mesh_draw(m0))
    meshes.append(mesh_draw(m1))
    meshes.append(mesh_draw(m2))
    meshes.append(mesh_draw(m3))
    meshes.append(mesh_draw(m4))
    meshes.append(mesh_draw(m5))
    if mt:
        meshes.append(mesh_draw(mt))
    
    """
    
    tool0_plane = xdraw_frame(tool0_frame)
    tcp_plane = xdraw_frame(tcp_frame)
    
    if show_brep:
        
        b0, b1, b2, b3, b4, b5 = brep
        
        b0.Transform(R0rg)
        b1.Transform(R1rg)
        b2.Transform(R2rg)
        b3.Transform(R3rg)
        b4.Transform(R4rg)
        b5.Transform(R5rg)
        
        robot_brep = [b0, b1, b2, b3, b4, b5]
# ---------- end draw_5 ----------
tool0_plane_2 = Plane(draw_5.tool0_plane)
tcp_plane_2 = Plane(draw_5.tcp_plane)
robot_brep_2 = Brep(draw_5.robot_brep)
draw_6 = RepresentPlaneAsLines(plane=tcp_plane_2, size=100)  # -> G, C; same code as draw_4
preview_5 = CustomPreview(Geometry=draw_5.meshes, Shader=ColourSwatch(SwatchColor=RGBA(99, 94, 94, 96)))
preview_6 = CustomPreview(Geometry=draw_6.G, Shader=draw_6.C)

# ----
mesh_3 = Mesh(draw_5.meshes)

# ---- group: Send joint position directly to robot
panel_32 = Panel("move cartesian")
idx = Slider(0, range=0..100)
commands_3 = Data(python_3)
item = ListItem(List=commands_3, Index=idx, Wrap=True)
list_10 = ValueList({"send all positions": 0, "send only one position": 1}, selected="send only one position")
filter_5 = StreamFilter(Gate=list_10, Stream0=commands_3, Stream1=item)
movel = PythonScript(commands=filter_5, velocity=Slider(100, range=0..100))  # -> script; inputs commands: list
# ---------- movel: Python ----------
from scriptcontext import sticky as st

script_lines = []
for cmd in commands:
    #q, a=1.4, v=1.05, t=0, r=0)
    x, y, z, ax, ay, az, speed, radius = cmd
    script_lines.append("movel(p%s, v=%f, r=%f)" % (str([x/1000., y/1000., z/1000, ax, ay, az]), speed/1000., radius/1000.))

robot = st["robot"]
tool_angle_axis = list(robot.tool.tcp_frame.point) + robot.tool.tcp_frame.axis_angle_vector
x, y, z, ax, ay, az = tool_angle_axis

script = "def prog():\n"
script += "\ttextmsg(\">> program start\")\n"
script += "\tset_tcp(p%s)\n" % str([x/1000., y/1000., z/1000, ax, ay, az])
script += "".join(["\t%s\n" % line for line in script_lines])
script += "\ttextmsg(\"<< program end\")\n"
script += "end\n"
script += "prog()\n\n"

print script
# ---------- end movel ----------
send_7 = Button()
send_8 = Send(script=movel, send=send_7)
panel_33 = Panel(send_8)

# ----
panel_34 = Panel("move vertical")
movel_2 = PythonScript()  # -> script
# ---------- movel_2: Python ----------
from scriptcontext import sticky as st

robot = st["robot"]
tool_angle_axis = list(robot.tool.tcp_frame.point) + robot.tool.tcp_frame.axis_angle_vector
x, y, z, ax, ay, az = tool_angle_axis

script = "def prog():\n"
script += "\ttextmsg(\">> program start\")\n"
script += "\tset_tcp(p%s)\n" % str([x/1000., y/1000., z/1000, ax, ay, az])
script += "\tcurrent_pose = get_forward_kin()\n"
script += "\tmovel(p[current_pose[0], current_pose[1], current_pose[2], 0, 0, 0], a=0.1, v=0.1)\n"
script += "\ttextmsg(\"<< program end\")\n"
script += "end\n"
script += "prog()\n\n"

print script
# ---------- end movel_2 ----------
send_9 = Button()
send_10 = Send(script=movel_2, send=send_9)
panel_35 = Panel(send_10)

panel_36 = Panel("set digital out")
number = Slider(2, range=0..10)
value = BooleanToggle(False)
digital_out = PythonScript(number=number, value=value)  # -> script; inputs number: Int32, value: Boolean
# ---------- digital_out: Python ----------
script = "def prog():\n"
script += "\ttextmsg(\">> program start\")\n"
script += "\tset_digital_out(%i, %s)\n" % (int(number), str(value))
script += "\ttextmsg(\"<< program end\")\n"
script += "end\n"
script += "prog()\n\n"

print script
# ---------- end digital_out ----------
send_11 = Button()
send_12 = Send(script=digital_out, send=send_11)
panel_37 = Panel(send_12)

# ---- group: Send joint position directly to robot
idx_2 = Slider(0, range=0..100)
commands_4 = Data(python_4)
item_2 = ListItem(List=commands_4, Index=idx_2, Wrap=True)
list_11 = ValueList({"send all positions": 0, "send only one position": 1}, selected="send only one position")
filter_6 = StreamFilter(Gate=list_11, Stream0=commands_4, Stream1=item_2)
movel_3 = PythonScript(commands=filter_6, velocity=Slider(100, range=0..100))  # -> script; inputs commands: list; same code as movel
send_13 = Button()
send_14 = Send(script=movel_3, send=send_13)
panel_39 = Panel(send_14)

# ----
number_2 = Slider(2, range=0..10)
value_2 = BooleanToggle(False)
digital_out_2 = PythonScript(number=number_2, value=value_2)  # -> script; inputs number: Int32, value: Boolean; same code as digital_out
send_15 = Button()
send_16 = Send(script=digital_out_2, send=send_15)
panel_41 = Panel(send_16)

movel_4 = PythonScript()  # -> script; same code as movel_2
send_17 = Button()
send_18 = Send(script=movel_4, send=send_17)
panel_43 = Panel(send_18)

# ----
# move incremental in WCS
number_slider_2 = Slider(5, range=-10..10)
list_12 = ValueList({"xaxis", "yaxis", "zaxis"}, selected="zaxis")
movel_5 = PythonScript(step_size=number_slider_2, direction=list_12)  # -> script
# ---------- movel_5: Python ----------
from scriptcontext import sticky as st

robot = st["robot"]
tool_angle_axis = list(robot.tool.tcp_frame.point) + robot.tool.tcp_frame.axis_angle_vector
x, y, z, ax, ay, az = tool_angle_axis

script = "def prog():\n"
script += "\ttextmsg(\">> program start\")\n"
script += "\tset_tcp(p%s)\n" % str([x/1000., y/1000., z/1000, ax, ay, az])
script += "\tcurrent_pose = get_forward_kin()\n"


if direction == "xaxis":
    script += "\tmovel(p[current_pose[0] + %f, current_pose[1], current_pose[2], current_pose[3], current_pose[4], current_pose[5]], t=%f)\n" % (step_size/1000., step_size * 0.1)

elif direction == "yaxis":
    script += "\tmovel(p[current_pose[0], current_pose[1] + %f, current_pose[2], current_pose[3], current_pose[4], current_pose[5]], t=%f)\n" % (step_size/1000., step_size * 0.1)

else: # direction == "zaxis":
    script += "\tmovel(p[current_pose[0], current_pose[1], current_pose[2] + %f, current_pose[3], current_pose[4], current_pose[5]], t=%f)\n" % (step_size/1000., step_size * 0.1)

script += "\ttextmsg(\"<< program end\")\n"
script += "end\n"
script += "prog()\n\n"

print script
# ---------- end movel_5 ----------
send_19 = Button()
send_20 = Send(script=movel_5, send=send_19)
panel_44 = Panel(send_20)

# ----
# move incremental in TCS
get_current_pose = Button()
list_13 = ValueList({"xaxis", "yaxis", "zaxis"}, selected="zaxis")
movel_6 = PythonScript(get=get_current_pose, step_size=Slider(5, range=-10..10), direction=list_13)  # -> script; inputs get: list
# ---------- movel_6: Python ----------
from scriptcontext import sticky as st
from compas.geometry import Frame
from compas.geometry import Point, Vector
from ur_online_control.ur_direct import get_current_pose_cartesian

server_address = st["server_address"]
server_port = 30005
ur_ip = st["ur_ip"]
robot = st["robot"]
tool_angle_axis = list(robot.tool.tcp_frame.point) + robot.tool.tcp_frame.axis_angle_vector
print tool_angle_axis

guid = str(ghenv.Component.InstanceGuid)
pose_cartesian_key = "pose_cartesian" + guid

if get:
    st[pose_cartesian_key] = get_current_pose_cartesian(server_address, server_port, ur_ip, tool_angle_axis)

if pose_cartesian_key not in st:
    pose_cartesian = []
    script = ""
else:
    pose_cartesian = st[pose_cartesian_key]

    robot = st["robot"]
    tool_angle_axis = list(robot.tool.tcp_frame.point) + robot.tool.tcp_frame.axis_angle_vector
    x, y, z, ax, ay, az = tool_angle_axis
    
    script = "def prog():\n"
    script += "\ttextmsg(\">> program start\")\n"
    script += "\tset_tcp(p%s)\n" % str([x/1000., y/1000., z/1000, ax, ay, az])
    script += "\tcurrent_pose = get_forward_kin()\n"
    
#    frame = Frame.from_pose_axis_angle_vector(pose_cartesian)
    frame = Frame.from_axis_angle_vector([ax, ay, az])
    frame.point = [x, y, z]

    if direction == "xaxis":
        next_vector = Vector(*frame.xaxis) * step_size
    elif direction == "yaxis":
        next_vector = Vector(*frame.yaxis) * step_size
    else: # direction == "zaxis":
        next_vector = Vector(*frame.zaxis) * step_size
    
    x, y, z = next_vector
    script += "\tmovel(p[current_pose[0] + %f, current_pose[1] + %f, current_pose[2] + %f, current_pose[3], current_pose[4], current_pose[5]], t=%f)\n" % (x/1000., y/1000., z/1000., step_size * 0.1)
    
    script += "\ttextmsg(\"<< program end\")\n"
    script += "end\n"
    script += "prog()\n\n"
    
    print script
# ---------- end movel_6 ----------
send_21 = Button()
send_22 = Send(script=movel_6, send=send_21)
panel_45 = Panel(send_22)

# ----
# move incremental in WCS
number_slider_3 = Slider(5, range=-10..10)
list_14 = ValueList({"xaxis", "yaxis", "zaxis"}, selected="zaxis")
movel_7 = PythonScript(step_size=number_slider_3, direction=list_14)  # -> script; same code as movel_5
send_23 = Button()
send_24 = Send(script=movel_7, send=send_23)
panel_46 = Panel(send_24)

# ----
# move incremental in TCS
get_current_pose_2 = Button()
list_15 = ValueList({"xaxis", "yaxis", "zaxis"}, selected="zaxis")
movel_8 = PythonScript(get=get_current_pose_2, step_size=Slider(5, range=-10..10), direction=list_15)  # -> script; inputs get: list; same code as movel_6
send_25 = Button()
send_26 = Send(script=movel_8, send=send_25)
panel_47 = Panel(send_26)

# ---- group: Send joint position directly to robot
idx_3 = Slider(0, range=0..100)
panel_48 = Panel("move joints")
joint_positions = Data(py_5)
item_3 = ListItem(List=joint_positions, Index=idx_3, Wrap=True)
list_16 = ValueList({"send all positions": 0, "send only one position": 1}, selected="send only one position")
filter_7 = StreamFilter(Gate=list_16, Stream0=joint_positions, Stream1=item_3)
movej = PythonScript(joint_positions=filter_7, velocity=Slider(153, range=0..200))  # -> script; inputs joint_positions: list
# ---------- movej: Python ----------
script_lines = []

for position in joint_positions:
    script_lines.append("movej(%s, v=%f)" % (str(position), velocity/1000.))


script = "def prog():\n"
script += "\ttextmsg(\">> program start\")\n"
script += "".join(["\t%s\n" % line for line in script_lines])
script += "\ttextmsg(\"<< program end\")\n"
script += "end\n"
script += "prog()\n\n"


print script

#script = ""
# ---------- end movej ----------
send_27 = Button()

# ----
send_28 = Send(script=movej, send=send_27)

# ---- group: Send joint position directly to robot (continued)
panel_49 = Panel(send_28)

idx_4 = Slider(0, range=0..100)
joint_positions_2 = Data(py_9)
item_4 = ListItem(List=joint_positions_2, Index=idx_4, Wrap=True)
list_17 = ValueList({"send all positions": 0, "send only one position": 1}, selected="send only one position")
filter_8 = StreamFilter(Gate=list_17, Stream0=joint_positions_2, Stream1=item_4)
movej_2 = PythonScript(joint_positions=filter_8, velocity=Slider(153, range=0..200))  # -> script; inputs joint_positions: list; same code as movej
send_29 = Button()

# ----
send_30 = Send(script=movej_2, send=send_29)

# ---- group: Send joint position directly to robot (continued)
panel_51 = Panel(send_30)

# ==== cluster Tools
tool_id = ClusterInput()

yaxis_line = Curve(<curve referenced from the Rhino model>)
sand_tool = Geometry([<brep referenced from the Rhino model> x3])
xaxis_line = Curve(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)
mesh = Mesh(sand_tool)
brep = Brep(sand_tool)
tool = Tool(M=mesh, brep=brep, xline=xaxis_line, yline=yaxis_line)

# ---- group: measurement tool
measurement_tool_geo = Geometry([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])
tool_2 = PythonScript(brep=measurement_tool_geo)  # -> tool; inputs brep: list
# ---------- tool_2: Python ----------
from ur_online_control.ur.tools import MeasurementTool

tool = MeasurementTool()
tool.brep = brep
# ---------- end tool_2 ----------

# ----
tool_id_2 = Integer(tool_id)
filter = StreamFilter(Gate=tool_id_2, Stream1=tool_2, Stream2=tool)
py = PythonScript(tool=filter)  # -> tcp_frame, model
# ---------- py: Python ----------
from compas_ghpython import mesh_draw 

tcp_frame = tool.tcp_frame
model = mesh_draw(tool.model)
# ---------- end py ----------
tool_3 = Data(filter)
tool_4 = ClusterOutput(tool_3)
draw = PythonScript(frame=py.tcp_frame)  # -> G, C
# ---------- draw: Python ----------
import Rhino.Geometry as rg
from System.Drawing import Color

if not size:
    size = 100

if frame:
    
    plane = rg.Plane(rg.Point3d(*frame.point), rg.Vector3d(*frame.xaxis), rg.Vector3d(*frame.yaxis))

    G = []
    G.append(rg.Line(plane.Origin, size * plane.XAxis))
    G.append(rg.Line(plane.Origin, size * plane.YAxis))
    G.append(rg.Line(plane.Origin, size * plane.ZAxis))
    
    C = []
    C.append(Color.FromArgb(255, 0, 0))
    C.append(Color.FromArgb(0, 255, 0))
    C.append(Color.FromArgb(0, 0, 255))
# ---------- end draw ----------
preview = CustomPreview(Geometry=draw.G, Shader=draw.C)
preview_2 = CustomPreview(Geometry=py.model, Shader=ColourSwatch(SwatchColor=RGB(141, 170, 178)))

# ==== cluster Send
script = ClusterInput()
send = ClusterInput()
send_2 = PythonScript(script=script, send=send)  # -> out
# ---------- send_2: Python ----------
import socket
from scriptcontext import sticky as st

ur_ip = st["ur_ip"]
ur_port = 30002

if send:
    s = socket.create_connection((ur_ip, ur_port), timeout=0.5) 
    s.send(script)
    s.close()
# ---------- end send_2 ----------
out = ClusterOutput(send_2)

# ==== cluster Draw
size = ClusterInput()
frame = ClusterInput()
draw = PythonScript(frame=frame, size=size)  # -> G, C; same code as draw
G = ClusterOutput(draw.G)
C = ClusterOutput(draw.C)

# ==== cluster Tools_2
brep = Brep([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])
tool_id = ClusterInput()

# ---- group: measurement tool
measurement_tool_geo = Geometry([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])
mesh = Mesh(measurement_tool_geo)
mjoin = MeshJoin(Meshes=mesh)
tool = PythonScript(meshes=mjoin, brep=measurement_tool_geo)  # -> tool; inputs meshes: list, brep: list
# ---------- tool: Python ----------
from ur_online_control.ur.tools import MeasurementTool
from compas.datastructures import Mesh
from compas_rhino.helpers import mesh_from_guid


tool = MeasurementTool()
tool.model = [mesh_from_guid(Mesh, mesh) for mesh in meshes]
#tool.model_xyz = tool.model.xyz
tool.brep = brep
# ---------- end tool ----------

# ---- group: extruder
yaxis_line = Curve(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)
test_geometry = Geometry(brep)
xaxis_line = Curve(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)
brep_2 = Brep(test_geometry)
mesh_2 = Mesh(test_geometry)
tool_2 = Tool_2(meshes=mesh_2, breps=brep_2, xline=xaxis_line, yline=yaxis_line)

# ----
tool_id_2 = Integer(tool_id)
filter = StreamFilter(Gate=tool_id_2, Stream1=tool, Stream2=tool_2)
py = PythonScript(tool=filter)  # -> tcp_frame, model
# ---------- py: Python ----------
from compas_ghpython import mesh_draw 

tcp_frame = tool.tcp_frame
model = map(mesh_draw, tool.model)
# ---------- end py ----------
tool_3 = Data(filter)
draw = PythonScript(frame=py.tcp_frame)  # -> G, C
# ---------- draw: Python ----------
import Rhino.Geometry as rg
from System.Drawing import Color

if not size:
    size = 100

if frame:
    plane = rg.Plane(rg.Point3d(*list(frame.point)), rg.Vector3d(*list(frame.xaxis)), rg.Vector3d(*list(frame.yaxis)))

    G = []
    G.append(rg.Line(plane.Origin, size * plane.XAxis))
    G.append(rg.Line(plane.Origin, size * plane.YAxis))
    G.append(rg.Line(plane.Origin, size * plane.ZAxis))
    
    C = []
    C.append(Color.FromArgb(255, 0, 0))
    C.append(Color.FromArgb(0, 255, 0))
    C.append(Color.FromArgb(0, 0, 255))
# ---------- end draw ----------
tool_4 = ClusterOutput(tool_3)
preview = CustomPreview(Geometry=draw.G, Shader=draw.C)
preview_2 = CustomPreview(Geometry=py.model, Shader=ColourSwatch(SwatchColor=RGB(141, 170, 178)))

# ==== cluster Tools_3

# ---- group: spray_gun
brep = Brep([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])
yaxis_line = Curve(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)
test_geometry = Geometry(brep)
xaxis_line = Curve(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)
mesh = Mesh(test_geometry)
brep_2 = Brep(test_geometry)
tool = Tool_3(meshes=mesh, breps=brep_2, xline=xaxis_line, yline=yaxis_line)

# ----
brep_3 = Brep([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])
tool_id = ClusterInput()
yaxis_line_2 = Curve(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)
xaxis_line_2 = Curve(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)

# ---- group: extruder
test_geometry_2 = Geometry(brep_3)
mesh_2 = Mesh(test_geometry_2)
brep_4 = Brep(test_geometry_2)
tool_2 = Tool_3(meshes=mesh_2, breps=brep_4, xline=xaxis_line_2, yline=yaxis_line_2)

# ----
tool_id_2 = Integer(tool_id)
tool_3 = PythonScript()  # -> tool
# ---------- tool_3: Python ----------
from compas_fab.fab.geometry import Frame
from compas_fab.fab.robots import Tool
import Rhino.Geometry as rg
import math

startPlane = rg.Plane.WorldXY
startPlane2 = rg.Plane.WorldXY
rg.Plane.Rotate(startPlane2, math.radians(180), rg.Vector3d.XAxis, rg.Point3d(0.0, 0.0, 0.0))

xform = rg.Transform.ChangeBasis(startPlane, startPlane2)

print startPlane
print startPlane2
Frame([0,0,0],[1,0,0],[0,-1,0])
#tcp_frame = Frame.worldXY()
tcp_frame = Frame([0,0,0],[1,0,0],[0,-1,0])

tool = Tool(tcp_frame)
tool.model = []
tool.breps = []
# ---------- end tool_3 ----------
filter = StreamFilter(Gate=tool_id_2, Stream0=tool_3, Stream1=tool, Stream2=tool_2)
py = PythonScript(tool=filter)  # -> tcp_frame, model
# ---------- py: Python ----------
tcp_frame = tool.tcp_frame
model = tool.model
# ---------- end py ----------
draw = PythonScript(frame=py.tcp_frame)  # -> G, C; same code as draw
tool_4 = Data(filter)
tool_5 = ClusterOutput(tool_4)
preview = CustomPreview(Geometry=draw.G, Shader=draw.C)
preview_2 = CustomPreview(Geometry=py.model, Shader=ColourSwatch(SwatchColor=RGB(141, 170, 178)))

# ==== cluster Tool
M = ClusterInput()
mjoin = MeshJoin(Meshes=M)
brep = ClusterInput()
xline = ClusterInput()
yline = ClusterInput()
tool = PythonScript(mesh=mjoin, brep=brep, xline=xline, yline=yline)  # -> tool; inputs mesh: Mesh, brep: list
# ---------- tool: Python ----------
import Rhino.Geometry as rg
from compas.geometry import Frame
from ur_online_control.ur.tool import Tool
from compas.datastructures import Mesh

xaxis = rg.Line(xline.PointAtStart, xline.PointAtEnd)
yaxis = rg.Line(yline.PointAtStart, yline.PointAtEnd)

if xaxis.From.DistanceTo(yaxis.From) < 0.01:
    origin = xaxis.From
    xaxis = xaxis.Direction
    yaxis = yaxis.Direction
elif xaxis.To.DistanceTo(yaxis.To) < 0.01:
    origin = xaxis.To
    xaxis = -xaxis.Direction
    yaxis = -yaxis.Direction
elif xaxis.From.DistanceTo(yaxis.To) < 0.01:
    origin = xaxis.From
    xaxis = xaxis.Direction
    yaxis = -yaxis.Direction
elif xaxis.To.DistanceTo(yaxis.From) < 0.01:
    origin = xaxis.To
    xaxis = -xaxis.Direction
    yaxis = yaxis.Direction

xaxis.Unitize()
yaxis.Unitize()

print origin
print xaxis
print yaxis

tcp_frame = Frame(origin, xaxis, yaxis)
vertices = [[v.X, v.Y, v.Z] for v in mesh.Vertices]
faces = map(list, mesh.Faces)

tool = Tool(tcp_frame)
tool.model = Mesh.from_vertices_and_faces(vertices, faces)
tool.model_xyz = tool.model.xyz
tool.brep = brep
# ---------- end tool ----------
tool_2 = ClusterOutput(tool)

# ==== cluster Tool_2
breps = ClusterInput()
meshes = ClusterInput()
meshes_2 = Mesh(meshes)
mjoin = MeshJoin(Meshes=meshes_2)
xline = ClusterInput()
yline = ClusterInput()
tool = PythonScript(meshes=mjoin, breps=breps, xline=xline, yline=yline)  # -> tool; inputs meshes: list of Mesh, breps: list of Brep
# ---------- tool: Python ----------
import Rhino.Geometry as rg
from compas.geometry import Frame
from ur_online_control.ur.tool import Tool
from compas.datastructures import Mesh
from compas_rhino.helpers import mesh_from_guid

xaxis = rg.Line(xline.PointAtStart, xline.PointAtEnd)
yaxis = rg.Line(yline.PointAtStart, yline.PointAtEnd)

if xaxis.From.DistanceTo(yaxis.From) < 0.01:
    origin = xaxis.From
    xaxis = xaxis.Direction
    yaxis = yaxis.Direction
elif xaxis.To.DistanceTo(yaxis.To) < 0.01:
    origin = xaxis.To
    xaxis = -xaxis.Direction
    yaxis = -yaxis.Direction
elif xaxis.From.DistanceTo(yaxis.To) < 0.01:
    origin = xaxis.From
    xaxis = xaxis.Direction
    yaxis = -yaxis.Direction
elif xaxis.To.DistanceTo(yaxis.From) < 0.01:
    origin = xaxis.To
    xaxis = -xaxis.Direction
    yaxis = yaxis.Direction

xaxis.Unitize()
yaxis.Unitize()

print origin
print xaxis
print yaxis

tcp_frame = Frame(origin, xaxis, yaxis)

tool = Tool(tcp_frame)
tool.model = [mesh_from_guid(Mesh, mesh) for mesh in meshes]
#tool.model_xyz = tool.model.xyz
tool.breps = breps
# ---------- end tool ----------
tool_2 = ClusterOutput(tool)

# ==== cluster Tool_3
breps = ClusterInput()
meshes = ClusterInput()
meshes_2 = Mesh(meshes)
mjoin = MeshJoin(Meshes=meshes_2)
xline = ClusterInput()
yline = ClusterInput()
tool = PythonScript(meshes=mjoin, breps=breps, xline=xline, yline=yline)  # -> tool; inputs meshes: list of Mesh, breps: list of Brep
# ---------- tool: Python ----------
import Rhino.Geometry as rg
from compas_fab.fab.geometry import Frame
from compas_fab.fab.robots import Tool
from compas.datastructures.mesh import Mesh

xaxis = rg.Line(xline.PointAtStart, xline.PointAtEnd)
yaxis = rg.Line(yline.PointAtStart, yline.PointAtEnd)

if xaxis.From.DistanceTo(yaxis.From) < 0.01:
    origin = xaxis.From
    xaxis = xaxis.Direction
    yaxis = yaxis.Direction
elif xaxis.To.DistanceTo(yaxis.To) < 0.01:
    origin = xaxis.To
    xaxis = -xaxis.Direction
    yaxis = -yaxis.Direction
elif xaxis.From.DistanceTo(yaxis.To) < 0.01:
    origin = xaxis.From
    xaxis = xaxis.Direction
    yaxis = -yaxis.Direction
elif xaxis.To.DistanceTo(yaxis.From) < 0.01:
    origin = xaxis.To
    xaxis = -xaxis.Direction
    yaxis = yaxis.Direction

xaxis.Unitize()
yaxis.Unitize()

print origin
print xaxis
print yaxis

tcp_frame = Frame(origin, xaxis, yaxis)

tool = Tool(tcp_frame)
tool.model = meshes
tool.breps = breps
# ---------- end tool ----------
tool_2 = ClusterOutput(tool)
