# Grasshopper definition 181003_RandomWalks_DJ.gh (Grasshopper 1.0.7)

number_slider = Slider(21576260, range=0..100000000)  # disabled
amount = Slider(728, range=0..1000)  # disabled
size = Slider(559, range=0..1000)  # disabled
ghpython_script = GhPythonScript(SEED=Slider(21576260, range=0..100000000))  # -> out, temp_geom, RandomWalker
# ---------- ghpython_script: Python ----------
import Rhino.Geometry as rg

import random as r
r.seed(SEED)
import math as m


class RandomWalker(object):
    """Simple random walker object.
    """
    def __init__(self, origin_pt, x_step = 1, y_step = 2):
        self.o_pt = origin_pt
        self.pos = origin_pt
        self.x_s = x_step
        self.y_s = y_step
        
        self.walking_pts = []
    
    def step(self):
        self.pos.X += r.randint(-self.x_s,self.x_s)
        self.pos.Y += r.randint(-self.y_s,self.y_s)
        self.walking_pts.append(rg.Point3d(self.pos))
    
    def __repr__(self):
        return ("Random Walker instance with orign pt: " + str(self.o_pt)
                    + " and step size x: " + str(self.x_s)
                    + " and step size y: " + str(self.y_s))

walker_1 = RandomWalker(rg.Point3d(0,0,0))
walker_2 = RandomWalker(rg.Point3d(10,10,10),3,5)

print walker_1, "walker_1"
print walker_2, "walker_2"

#for i in range(1000):
#    walker_1.step()
#temp_geom = walker_1.walking_pts
# ---------- end ghpython_script ----------
ghpython_script_2 = GhPythonScript(SEED=number_slider, amount=amount, size=size)  # -> out, temp_geom, polyline, temp_lines; inputs amount: Int32, size: Int32; disabled
# ---------- ghpython_script_2: Python ----------
import Rhino.Geometry as rg

import random as r
r.seed(SEED)

import math as m



temp_geom = []
# generate random point in 2d


#x = r.randint(-size, size)
#y = r.randint(-size, size)
#
#temp_pt = rg.Point3d(x,y,0)
#temp_geom.append(temp_pt)
#print temp_geom

# generate random point in 3d


# generate a series of random points in 2d

#for i in range(amount):
#    x = r.randint(-size, size)
#    y = r.randint(-size, size)
#    
#    temp_pt = rg.Point3d(x,y,0)
#    temp_geom.append(temp_pt)
#print temp_geom

# generate a series of random points in 2d
# 1. boundary as a rectangle

#size_x = r.randint(int(size/2), size)
#size_y = r.randint(int(size/2), size)
#
#size_x = 500
#size_y = 1000
#
#for i in range(amount):
#    x = r.randint(-size_x, size_x)
#    y = r.randint(-size_y, size_y)
#    
#    temp_pt = rg.Point3d(x,y,0)
#    temp_geom.append(temp_pt)


# 2. boundary as a circle

#for i in range(amount):
#    alpha = r.randint(0,360)
#    r_alpha = m.radians(alpha)
#    
#    radius = r.randint(0, size**2)
#    # sqrt avoids clustering
#    radius = m.sqrt(radius)
#    
#    # radius = size if you want points on a circle
#    # radial coordinate = radius * alpha
#    x = radius * m.cos(r_alpha)
#    y = radius * m.sin(r_alpha)
#    
#    
#    temp_pt = rg.Point3d(x,y,0)
#    temp_geom.append(temp_pt)
#
#polyline = rg.Curve.CreateInterpolatedCurve(temp_geom,1)


# generate a series of random pts 3d
# 1. boundary as a square
# 2. boundary as a cuboid 
# 3. boundary as a sphere


# random walks
# random walk in 2d

#x = 0
#y = 0
#
#for i in range(amount):
#    temp_pt = rg.Point3d(x,y,0)
#    temp_geom.append(temp_pt)
#    
#    x += r.randint(-1,1)
#    y += r.randint(-1,1)

#polyline = rg.Curve.CreateInterpolatedCurve(temp_geom,1)


walking_pt = rg.Point3d(0,0,0)
for i in range(amount):
    temp_geom.append(rg.Point3d(walking_pt))
    walking_pt.X += r.randint(-1,1)
    walking_pt.Y += r.randint(-1,1)

temp_lines = []
for pt in temp_geom:
    for other_pt in temp_geom:
        # if rg.Point3d.DistanceTo(pt,other_pt)
        if pt.DistanceTo(other_pt) > 0 and pt.DistanceTo(other_pt) < 4:
            temp_line = rg.Line(pt, other_pt)
            temp_lines.append(temp_line)

#polyline = rg.Curve.CreateInterpolatedCurve(temp_geom,1)
#
#print len(temp_geom)
#
#a = 10
#test_list = [a]
#print test_list
#a = 20
#print test_list



# in addition
# 1. create a boundary (square, rectangular, circular, free-form)
# 2. do the same in 3d
# 3. explore  the graphic outcome
# ---------- end ghpython_script_2 ----------
panel = Panel(ghpython_script_2.out)  # disabled
geometry = Geometry(ghpython_script_2.temp_geom)  # disabled
geometry_2 = Geometry(ghpython_script_2.polyline)  # disabled
geometry_3 = Geometry(ghpython_script_2.temp_lines)  # disabled
point = Point(<point referenced from the Rhino model>)
ghpython_script_3 = GhPythonScript(
    RandomWalker=ghpython_script.RandomWalker,
    origin_pt=point,
    x_step=Slider(5, range=0..10),
    y_step=Slider(2, range=0..10),
    step=Button())  # -> out, walking_pts; inputs origin_pt: Point3d, x_step: Int32, y_step: Int32, step: Boolean
# ---------- ghpython_script_3: Python ----------
walker_1 = RandomWalker(origin_pt, x_step, y_step)


if step:
    walker_1.step()

walking_pts = walker_1.walking_pts
# ---------- end ghpython_script_3 ----------
geometry_4 = Geometry(ghpython_script_3.walking_pts)
panel_2 = Panel(ghpython_script_3.out)
polyline = PolyLine(Vertices=geometry_4, Closed=False)
