# Grasshopper definition axolotlgh.gh (Grasshopper 1.0.7)
# plug-ins: Kangaroo2 Components

mydodecahedron = GhPythonScript(x=Slider(6.9, range=0..10))  # -> out, a, b
# ---------- mydodecahedron: Python ----------
__author__ = "user"
__version__ = "2018.10.25"

import rhinoscriptsyntax as rs

from axolotlmas.primitives import *
from axolotlmas.microstructures import *

d = Dodecahedron(rad=x)

a = [rs.CreatePoint(n.x,n.y,n.z) for n in d.get_mesh().nodes]
b = d
# ---------- end mydodecahedron ----------
mysphere = GhPythonScript(x=Slider(4.6, range=0..10))  # -> out, a, b
# ---------- mysphere: Python ----------
__author__ = "user"
__version__ = "2018.10.25"

import rhinoscriptsyntax as rs

from axolotlmas.primitives import *
from axolotlmas.microstructures import *

s = Sphere(3,4,5,x)
#g = Gyroid()

a = [rs.CreatePoint(n.x,n.y,n.z) for n in s.get_mesh().nodes]
b = s
# ---------- end mysphere ----------
subdivisionlevel = Slider(5, range=0..10)
booleanunion = GhPythonScript(obja=mysphere.b, objb=mydodecahedron.b)  # -> out, a
# ---------- booleanunion: Python ----------
__author__ = "user"
__version__ = "2018.10.25"

import rhinoscriptsyntax as rs

from axolotlmas.combinations import *

a = Union(obja, objb)
# ---------- end booleanunion ----------
distanceevaluation = GhPythonScript(distobj=booleanunion.a, sl=subdivisionlevel)  # -> out, a; inputs sl: Int32
# ---------- distanceevaluation: Python ----------
__author__ = "user"
__version__ = "2018.10.25"

import rhinoscriptsyntax as rs

import axolotlmas.octree as oc
from axolotlmas.meshobjs import *

mcmesh = Mesh()
ot = oc.OcTree(Vector(0,0,0),20)
ot.set_level(sl)
ot.distobj = distobj
ot.divide(ot.rootnode, mcmesh)

a = mcmesh
# ---------- end distanceevaluation ----------
rhinomeshcreation = GhPythonScript(x=distanceevaluation.a)  # -> out, a
# ---------- rhinomeshcreation: Python ----------
__author__ = "user"
__version__ = "2018.10.25"

import rhinoscriptsyntax as rs
import Rhino.Geometry as rg

mesh = rg.Mesh()
x.collect_nodes()

for v in x.nodes:
    mesh.Vertices.Add(v.x,v.y,v.z)

for f in x.faces:
    if len(f.nodes)==4:
        n1 = f.nodes[0].id-1
        n2 = f.nodes[1].id-1
        n3 = f.nodes[2].id-1
        n4 = f.nodes[3].id-1
        mesh.Faces.AddFace(n1,n2,n3,n4)
    if len(f.nodes)==3:
        n1 = f.nodes[0].id-1
        n2 = f.nodes[1].id-1
        n3 = f.nodes[2].id-1
        mesh.Faces.AddFace(n1,n2,n3)
mesh.Normals.ComputeNormals()
mesh.Compact()

a = mesh
# ---------- end rhinomeshcreation ----------
combine_clean = CombineClean(Meshes=rhinomeshcreation.a)
custom_preview = CustomPreview(
    Geometry=combine_clean,
    Material={diffuse=RGB(221, 160, 221), emission=RGB(66, 48, 66), shine=0.5, specular=RGB(255, 255, 255), transparency=0})
